# Dynamo custom node GIS2BIM.WMTSRequestAndImport.dyf (Dynamo 1.3.1.1736)
# category: GIS2BIM.DutchGEO
# total node with WMTS webrequest and import of image in view

Zoomlevel = Input()
WMTSScaleSetNetherlands = Custom[GIS2BIM.WMTSScaleSetNetherlands](Zoomlevel=Zoomlevel)  # gives resolution, scaledenominator and number of tiles
Rdx = Input()
Rdy = Input()
WMTSZoomLevelTileRow = Custom[GIS2BIM.WMTSZoomLevelTileRow](Resolution=WMTSScaleSetNetherlands.Resolutie_m_pixel, Rdx=Rdx, Rdy=Rdy)  # gives the tilerow and tilecolumn for the WMTS webrequest
pixelWidth = CodeBlock { 256; }
Boundingboxwidth = Input()
WMTSTileListFromBbox = Custom[GIS2BIM.WMTSTileListFromBbox](TileRow=WMTSZoomLevelTileRow.TileRow, TileColumn=WMTSZoomLevelTileRow.TileColumn, Resolution=WMTSScaleSetNetherlands.Resolutie_m_pixel, PixelWidth=pixelWidth, Bbox=Boundingboxwidth)  # gives list of tilerows and tilecolums
View = Input()
Layer = Input()
WMTSGeoservicesLibraryNetherlands = Custom[GIS2BIM.WMTSGeoservicesLibraryNetherlands](TileRow=WMTSTileListFromBbox.TileRows, TileColumn=WMTSTileListFromBbox.TileColumns, Zoomlevel=WMTSScaleSetNetherlands.Zoomlevel, Layer=Layer)  # library with webrequests of WMTS-services in the Netherlands
TemppathFiles = Input()
webrequestWMTS = Custom[GIS2BIM.WebrequestWMTS](WMTSWebrequest=WMTSGeoservicesLibraryNetherlands, Temppath=TemppathFiles, TileRow=WMTSTileListFromBbox.TileRows, TileColumn=WMTSTileListFromBbox.TileColumns, Layer=Layer, Zoomlevel=Zoomlevel)
combineImages = Custom[GIS2BIM.CombineImages](ImageList=webrequestWMTS.TileFiles, TileRows=WMTSTileListFromBbox.TileRows, TileColumns=WMTSTileListFromBbox.TileColumns, NumberOfPixels=pixelWidth, Layer=webrequestWMTS.Layer)  # combine images from wmts webrequest
importImageInView = Custom[GIS2BIM.ImportImageInView](ImageWidthMeters=WMTSTileListFromBbox.TotalTileWidthMetrs, View=View, ImagePath=combineImages.ImagePath, Deltax=WMTSZoomLevelTileRow.DeltaX, Deltay=WMTSZoomLevelTileRow.DeltaY)  # Import rasterimage in view
Image = Output(combineImages.Watch_image)
