# Dynamo custom node GIStoBIM.Kadaster.dyf (Dynamo 1.3.1.1736)
# category: GIStoBIM.Geometry
# Draw propertylines and place streetnames and housenumbers from the dutch kadaster

view = Input()
from_meters_to_millimeters = CodeBlock { 1000; }
result_webrequest = Input()
code_block = CodeBlock { "gml:pos"; }
getXMLNode = Lists.DataSets.GetXMLNode(result_webrequest, code_block)
flatten = Flatten(getXMLNode)
code_block_2 = CodeBlock { " "; }
split = String.Split(flatten, code_block_2)
toNumber = String.ToNumber(split)
code_block_3 = CodeBlock { 1; 2; 0; }
rd_x = List.TakeEveryNthItem(arg1=code_block_3.out1, arg2=code_block_3.out0)  # unwired: arg0
map = List.Map(list=toNumber, f_x=rd_x)
mul = from_meters_to_millimeters * map
deltaX = Input()  # X-value of transformation of points and polygons
mul_2 = deltaX * from_meters_to_millimeters
x_convert_to_local_axis = mul - mul_2
rd_y = List.TakeEveryNthItem(arg1=code_block_3.out1, arg2=code_block_3.out2)  # unwired: arg0
map_2 = List.Map(list=toNumber, f_x=rd_y)
mul_3 = from_meters_to_millimeters * map_2
deltaY = Input()  # Y-value of transformation of points and polygons
mul_4 = deltaY * from_meters_to_millimeters
y_convert_to_local_axis = mul_3 - mul_4
code_block_4 = CodeBlock { 0; }
byCoordinates = Point.ByCoordinates(x=x_convert_to_local_axis, y=y_convert_to_local_axis, z=code_block_4)
pruneDuplicates = Point.PruneDuplicates(points=byCoordinates)
flatten_2 = Flatten(pruneDuplicates)
code_block_5 = CodeBlock { "kadastralekaartv3:classificatiecode"; }
getXMLNode_2 = Lists.DataSets.GetXMLNode(result_webrequest, code_block_5)
flatten_3 = Flatten(getXMLNode_2)
code_block_6 = CodeBlock { "kadastralekaartv3:tekst"; }
getXMLNode_3 = Lists.DataSets.GetXMLNode(result_webrequest, code_block_6)
flatten_4 = Flatten(getXMLNode_3)
TextnoteHousenumbers = Input(TextnoteHousenumbers: String= "2.5 mm")
byName = TextNoteType.ByName(TextnoteHousenumbers)

# group: HUISNUMMER
string = StringInput("Z02")
eq = string == flatten_3
filterByBoolMask = List.FilterByBoolMask(list=flatten_4, mask=eq)
flatten_5 = Flatten(filterByBoolMask.in)
string_2 = StringInput("Center")

code_block_7 = CodeBlock { "kadastralekaartv3:rotatiehoek"; }
getXMLNode_4 = Lists.DataSets.GetXMLNode(result_webrequest, code_block_7)
flatten_6 = Flatten(getXMLNode_4)
TextnoteStreetnames = Input(TextnoteStreetnames: String= "3.5 mm")
byName_2 = TextNoteType.ByName(TextnoteStreetnames)

# group: STRAATNAMEN
filterByBoolMask_2 = List.FilterByBoolMask(list=flatten_2, mask=eq)
filterByBoolMask_3 = List.FilterByBoolMask(list=flatten_6, mask=eq)
flatten_7 = Flatten(filterByBoolMask_2.out)
flatten_8 = Flatten(filterByBoolMask.out)
boolean = BoolSelector(true)
changeCase = String.ChangeCase(flatten_8, boolean)
string_3 = StringInput("Center")
flatten_9 = Flatten(filterByBoolMask_3.out)
toNumber_2 = String.ToNumber(flatten_9)
byLocation = TextNote.ByLocation(view=view, location=flatten_7, text=changeCase, alignment=string_3, type=byName_2, rotation=toNumber_2)

# group (continued): HUISNUMMER
flatten_10 = Flatten(filterByBoolMask_2.in)
flatten_11 = Flatten(filterByBoolMask_3.in)
toNumber_3 = String.ToNumber(flatten_11)
byLocation_2 = TextNote.ByLocation(view=view, location=flatten_10, text=flatten_5, alignment=string_2, type=byName, rotation=toNumber_3)
