# Dynamo custom node GIStoBIM.WebrequestWMS.dyf (Dynamo 1.3.1.1736)
# category: GIStoBIM.WebrequestActions
# imports the result(image) of a webrequest based on WMS-protocol into a view in Revit

WMSwebrequest = Input(WMSwebrequest: string)  # url for WMS webrequest
tempfolder = Input(tempfolder: string="C:/TEMP/")  # windowsfolder to save image
filename = Input()  # filename

# group: WEBREQUEST FOR FILE
code_block = CodeBlock { ".png"; }
concat = String.Concat(filename, code_block)
concat_2 = String.Concat(tempfolder, concat)
python_script = Python(IN[0]=WMSwebrequest, IN[1]=concat_2)
# ---------- python_script.python (11 lines) ----------
import sys
sys.path.append("C:\Program Files (x86)\IronPython 2.7\Lib")
from urllib import urlretrieve

url= IN[0]
tempfile= IN[1]


urlretrieve(url, tempfile)

OUT= tempfile
# ----------------------------------------
fromPath = FileObject(python_script)  # "File.FromPath"
readFromFile = Image.ReadFromFile(fromPath)
watch_image = Output(readFromFile)

boundingboxwidth_m = Input()  # "boundingboxwidth[m]"; width of the bounding box
view = Input()
code_block_2 = CodeBlock { 0; }
importImageInView = Custom[GIStoBIM.ImportImageInView](ImageWidthMeters=boundingboxwidth_m, view=view, ImagePath=python_script, deltax=code_block_2, deltay=code_block_2)  # Import rasterimage in view
