# Dynamo custom node GIS2BIM.BelgiumGeoservicesLibrary.dyf (Dynamo 1.3.2.2480)
# category: GIS2BIM.Geoservices.Europe
# Geoserviceslibrary in Belgium

# note: Check this link with all availabel layers:
# https://geoservices.informatievlaanderen.be/overdrachtdiensten/GRB/wfs?&request=GetCapabilities
code_block = CodeBlock()
# ---------- code_block.designscript (7 lines) ----------
"https://geoservices.informatievlaanderen.be/overdrachtdiensten/GRB/wfs?";
"&request=GetFeature";
"&typeName=GRB:ADP";
"&bbox=";

"&format=gml32";
"&crs=EPSG:31370";
# ----------------------------------------
BoundingboxString = Input(BoundingboxString: string)
concat = String.Concat(code_block.out0, code_block.out1, code_block.out2, code_block.out3, BoundingboxString, code_block.out4, code_block.out5)
CadastreParcels_GRB = Output(concat)  # "CadastreParcels(GRB:ADP)"
code_block_2 = CodeBlock()
# ---------- code_block_2.designscript (7 lines) ----------
"https://geoservices.informatievlaanderen.be/overdrachtdiensten/GRB/wfs?";
"&request=GetFeature";
"&typeName=GRB:GBG";
"&bbox=";

"&format=gml32";
"&crs=EPSG:31370";
# ----------------------------------------
concat_2 = String.Concat(code_block_2.out0, code_block_2.out1, code_block_2.out2, code_block_2.out3, BoundingboxString, code_block_2.out4, code_block_2.out5)
BuildingOutlines_GRB = Output(concat_2)  # "BuildingOutlines(GRB:GBG)"
code_block_3 = CodeBlock()
# ---------- code_block_3.designscript (7 lines) ----------
"https://geoservices.informatievlaanderen.be/overdrachtdiensten/GRB/wfs?";
"&request=GetFeature";
"&typeName=GRB:TBLGBGADR";
"&bbox=";

"&format=gml32";
"&crs=EPSG:31370";
# ----------------------------------------
concat_3 = String.Concat(code_block_3.out0, code_block_3.out1, code_block_3.out2, code_block_3.out3, BoundingboxString, code_block_3.out4, code_block_3.out5)
Housenumbers_GRB = Output(concat_3)  # "Housenumbers(GRB:TBLGBGADR)"
