# Dynamo custom node GIS2BIM_BAG3D.dyf (Dynamo 2.3.0.5885)
# category: GIS2BIM.DutchGEO
# Perform a WFS(Web Feature Service) webrequest based on a boundingbox of RD-coordinates(28992). Retrieve an xml-file. Read the metadata and create 3D-solids. Maximum of 1000 buildings per request.
# packages: GIS2BIM for Dynamo 2.x 0.11.11

BAG3DTUDelft_OGCWFS = Input(BAG3DTUDelft_OGCWFS: string)
web_request = WebRequest(url=BAG3DTUDelft_OGCWFS)

# group: WEBREQUEST & QUERY GML
string = StringInput(".//{3dbag}identificatie")  # graph input
string_2 = StringInput(".//{3dbag}bouwjaar")  # graph input
string_3 = StringInput(".//{http://www.opengis.net/gml}posList")  # graph input
string_4 = StringInput(".//{3dbag}ground-0.00")  # graph input
string_5 = StringInput(".//{3dbag}ground-0.50")  # graph input
string_6 = StringInput(".//{3dbag}roof-0.00")  # graph input
string_7 = StringInput(".//{3dbag}roof-0.50")  # graph input
string_8 = StringInput(".//{3dbag}roof-0.99")  # graph input
create = List.Create(item0=string, item1=string_2, item2=string_3, item3=string_4, item4=string_5, item5=string_6, item6=string_7, item7=string_8)

GIS2BIM_XMLXPath = Custom[GIS2BIM_XMLXPath](XMLString=web_request, XPathStrings=create)  # package GIS2BIM for Dynamo 2.x; Run an XPathquery on an xml-string
BAG_3D_Metadata_Values = Output(GIS2BIM_XMLXPath)
BAG_3D_Metadata_Xquery = Output(create)
RdX = Input(RdX: double)
RdY = Input(RdY: double)

# group: CONVERT GML TO SOLIDS
code_block = CodeBlock { "_none"; "0"; }
replace = String.Replace(str=GIS2BIM_XMLXPath, searchFor=code_block.out0, replaceWith=code_block.out1)
code_block_2 = CodeBlock(a=replace, rdx=RdX, rdy=RdY)
# ---------- code_block_2.designscript (19 lines) ----------
polygons=a[2];
zbottom=a[4];
ztop=a[6];
polygons2 = String.Split(polygons, [" "]);
polygons3 = DSCore.List.DropEveryNthItem(polygons2@-2<1>, 3, 0);
rdxlist = DSCore.String.ToNumber(DSCore.List.DropEveryNthItem(polygons3@-2<1>, 2, 0));
rdylist = DSCore.String.ToNumber(DSCore.List.DropEveryNthItem(polygons3@-2<1>, 2, 1));
xlocal= DSCore.Math.Round(1000*(rdxlist-rdx));
ylocal= DSCore.Math.Round(1000*(rdylist-rdy));
zlocalbottom=1000*(DSCore.String.ToNumber(zbottom));
zlocaltop=1000*(DSCore.String.ToNumber(ztop));
thickness=zlocaltop-zlocalbottom;
point1 = Point.ByCoordinates(xlocal, ylocal, zlocalbottom);
polyCurve1 = PolyCurve.ByPoints(point1, false);
surface1 = Surface.ByPatch(polyCurve1);
solid1 = surface1.Thicken(thickness, false);
solid2 = DSCore.Object.IsNull(solid1);
solid3 = List.FilterByBoolMask(solid1, solid2);
solid4 = Solid.ByUnion(solid3);
# ----------------------------------------

BAG_3DSolids_Per_Building = Output(code_block_2.solid1)
BAG_3DSolidUnion = Output(code_block_2.solid4)
