# Dynamo custom node GIS2BIM_CreateDetailLinesFromPolygons.dyf (Dynamo 2.2.1.5175)
# category: GIS2BIM.Revit
# Create detaillines from polygons in a view

PolyCurves = Input(PolyCurves: var[]..[])
explode = Geometry.Explode(geometry=PolyCurves)
flatten = List.Flatten(list=explode)
View = Input(View: var[]..[])
Linestyle = Input(Linestyle: var[]..[])

# group: CLOCKWORK DETAILLINE FROM CURVE
python_script = Python(IN[0]=flatten, IN[1]=View, IN[2]=Linestyle)
# ---------- python_script.python (40 lines) ----------
import clr
clr.AddReference('RevitAPI')
from Autodesk.Revit.DB import *

clr.AddReference("RevitNodes")
import Revit
clr.ImportExtensions(Revit.GeometryConversion)

clr.AddReference("RevitServices")
import RevitServices
from RevitServices.Persistence import DocumentManager
from RevitServices.Transactions import TransactionManager

doc = DocumentManager.Instance.CurrentDBDocument
curves = UnwrapElement(IN[0])
view = UnwrapElement(IN[1])
linetype = IN[2]
elementlist = []

collector = FilteredElementCollector(doc)
lstFilter = ElementClassFilter(GraphicsStyle)
lstCollector = collector.WherePasses(lstFilter).ToElements()
try:
	lstCollector = filter(lambda x: x.Name == linetype, lstCollector)
	linetype = filter(lambda x: x.GraphicsStyleCategory.CategoryType.__str__()=='Model', lstCollector)[0]
except:
	linetype = []

TransactionManager.Instance.EnsureInTransaction(doc)
if doc.IsFamilyDocument: 
	doc_create = doc.FamilyCreate
else: 
	doc_create = doc.Create
for curve in curves:
	detcurve = doc_create.NewDetailCurve(view, curve.ToRevitType())
	if linetype != []: 
		detcurve.LineStyle = linetype
	elementlist.append(detcurve)
TransactionManager.Instance.TransactionTaskDone()
OUT = elementlist
# ----------------------------------------
python_script_2 = Python(IN[0]=explode, IN[1]=python_script)
# ---------- python_script_2.python (4 lines) ----------
check = IN[0]
items = IN[1]
if isinstance(check, (list)): OUT = items
else: OUT = items[0]
# ----------------------------------------

Detaillines = Output(python_script_2)
