# Dynamo custom node GIS2BIM_FilterGML.dyf (Dynamo 2.10.1.3976)
# category: GIS2BIM.Geometry
# filter GML-file based on boundingbox

GMLFile = Input(GMLFile: var[]..[])  # path of GML-file
string = StringInput("\")
code_block = CodeBlock { "/"; }
replace = String.Replace(string=GMLFile, searchFor=string, replaceWith=code_block)
xPATH = Input(xPATH: var[]..[])  # xPathToSearchXML
CoordinateX = Input(CoordinateX: var[]..[])
CoordinateY = Input(CoordinateY: var[]..[])
Boundingbox = Input(Boundingbox: var[]..[])  # width and height of boundingbox
Scale = Input(Scale: int = 1000)  # connect polycurves
python_script = Python(IN[0]=replace, IN[1]=xPATH, IN[2]=CoordinateX, IN[3]=CoordinateY, IN[4]=Boundingbox, IN[5]=Scale)  # IronPython2
# ---------- python_script.python (86 lines) ----------
import sys
sys.path.append("C:\Program Files (x86)\IronPython 2.7\Lib")

import clr
import re
clr.AddReference('ProtoGeometry')
from Autodesk.DesignScript.Geometry import *

import xml.etree.ElementTree as ET
aDebug = []

def checkIfCoordIsInsideBoundingBox(coord, min_x, min_y, max_x, max_y):
	if re.match(r'^-?\d+(?:\.\d+)$', coord[0]) is None or re.match(r'^-?\d+(?:\.\d+)$', coord[1]) is None:
		return False
	else:
		if min_x <= float(coord[0]) <= max_x and min_y <= float(coord[1]) <= max_y:
			return True
		else:
		    return False
	
def mainFunction():
    # Inputs
    file_path = IN[0]
    xpathstr = IN[1]

    # Bounding box definition
    bbx = IN[2]
    bby = IN[3]
    bb_size = IN[4]
    scale = IN[5]
    bounding_box = [bbx, bby, bb_size]
    min_x = bounding_box[0] - (bounding_box[2] / 2)
    min_y = bounding_box[1] - (bounding_box[2] / 2)
    max_x = bounding_box[0] + (bounding_box[2] / 2)
    max_y = bounding_box[1] + (bounding_box[2] / 2)

    # get data from xml
    tree = ET.parse(file_path)
    root = tree.getroot()

    # for loop to get each element in an array
    XMLelements = []
    for elem in root.iter():
        XMLelements.append(elem)

    xpathfound = root.findall(xpathstr)

    # for loop to get all polygons in an array
    polygons = []
    for x in xpathfound:
        if x.text:
            try:
                polygons.append(x.text)
            except:
                polygons.append("_none_")
        else:
            polygons.append("_none_")

    # for loop to get each polygon as a list instead of a string
    newPolygons = []
    for polygon in polygons:
        newPolygons.append(polygon.split(" "))

    # for loop to get x,y coords and filter polygons inside Bounding Box
    xyPolygons = []
    for newPolygon in newPolygons:
        polygon_is_inside_bounding_box = False
        x = 0
        xyPolygon = []
        for i in range(0, int(len(newPolygon) / 2)):
            xy_coord = [newPolygon[x], newPolygon[x + 1]]
            xy_coord_trans = [round((float(newPolygon[x])-bbx)*scale), round((float(newPolygon[x + 1])-bby)*scale)]
            xyPolygon.append(xy_coord_trans)
            x += 2
            if checkIfCoordIsInsideBoundingBox(xy_coord, min_x, min_y, max_x, max_y):
                polygon_is_inside_bounding_box = True
        if polygon_is_inside_bounding_box:
            xyPolygons.append(xyPolygon)
    return xyPolygons

# execution of main function in python script
returnvalue = mainFunction()

# put returnValue in OUT
OUT = returnvalue, aDebug
#OUT = 
# ----------------------------------------
firstItem = List.FirstItem(list=python_script@@L2)
lastItem = List.LastItem(list=python_script@@L2)
byCoordinates = Point.ByCoordinates(x=firstItem, y=lastItem)
Points = Output(byCoordinates)
Connectpolycurves = Input(Connectpolycurves: bool = false)  # connect polycurves
byPoints = PolyCurve.ByPoints(points=byCoordinates, connectLastToFirst=Connectpolycurves)
Polycurves = Output(byPoints)
