# Dynamo custom node GIS2BIM_GetRevitSiteLocation.dyf (Dynamo 2.2.1.5175)
# category: GIS2BIM.Revit
# Gets the properties of the current Site Location of the active Revit Project

siteLocation = SiteLocation()  # graph input
string_from_object = FromObject(obj=siteLocation)
code_block = CodeBlock { "Name:"; "Lat"; }
split = String.Split(str=string_from_object, separator0=code_block.out0, separator1=code_block.out1)
code_block_2 = CodeBlock(a=split) { a[0]; }
Name = Output(code_block_2)
longitude = DynamoUnits.Location.Longitude(location=siteLocation)
string_from_object_2 = FromObject(obj=longitude)
Lon = Output(string_from_object_2)
latitude = DynamoUnits.Location.Latitude(location=siteLocation)
string_from_object_3 = FromObject(obj=latitude)
Lat = Output(string_from_object_3)
Location = Output(siteLocation)
