# Dynamo custom node GIS2BIM_GetWebServerData.dyf (Dynamo 2.12.1.8246)
# category: GIS2BIM.Geoservices
# Get webserverdata from github repository of GIS2BIM(up to date list of GIS-servers & requests)

code_block = CodeBlock { "https://raw.githubusercontent.com/DutchSailor/GIS2BIM/master/GIS2BIM_Data.json"; }
category = Input(category: string = "webserverRequests")
title = Input(title: string)
parameter = Input(parameter: string)
python_script = Python(IN[0]=code_block, IN[1]=category, IN[2]=title, IN[3]=parameter)  # CPython3
# ---------- python_script.python (21 lines) ----------
import sys
import json
import urllib
import urllib.request

url = IN[0]
category = IN[1]
servertitle = IN[2]
parameter = IN[3]

req = urllib.request.urlopen(url)
print (req)
req = req.read().decode('utf-8')
data = json.loads(req)['GIS2BIMserversRequests'][category]

test = []
for i in data:
	test.append(i["title"])
result = data[test.index(servertitle)][parameter]

OUT = result
# ----------------------------------------
parametervalue = Output(python_script)
