# Dynamo custom node GIS2BIM_KadasterPercelen.dyf (Dynamo 2.3.0.5885)
# category: GIS2BIM.DutchGEO
# Draw propertylines and place streetnames and housenumbers from the dutch kadaster
# packages: GIS2BIM for Dynamo 2.x 0.11.10

view = Input(view: var[]..[])
UrlWebrequestKadasterPerceel = Input(UrlWebrequestKadasterPerceel: var[]..[])
DeltaX = Input(DeltaX: var[]..[])  # X-value of transformation of points and polygons
string = StringInput(".//{http://kadastralekaartv3.geonovum.nl}perceelnummer_deltax")  # graph input
code_block = CodeBlock { 4; }
DeltaY = Input(DeltaY: var[]..[])  # Y-value of transformation of points and polygons
string_2 = StringInput(".//{http://kadastralekaartv3.geonovum.nl}perceelnummer_deltay")  # graph input
code_block_2 = CodeBlock { 4; }
code_block_3 = CodeBlock { 1000; }
string_3 = StringInput(".//{http://kadastralekaartv3.geonovum.nl}perceelnummer")  # graph input
code_block_4 = CodeBlock { 4; }
TextTypePerceel = Input(TextTypePerceel: var[]..[])

# group: PLACE TEXTNOTE FOR KADASTRAAL PERCEEL
web_request = WebRequest(url=UrlWebrequestKadasterPerceel)
string_4 = StringInput("Center")  # graph input
byName = TextNoteType.ByName(name=TextTypePerceel)

python_script = Python(IN[0]=web_request, IN[1]=string)
# ---------- python_script.python (53 lines) ----------
import clr
import sys
clr.AddReference('ProtoGeometry')
from Autodesk.DesignScript.Geometry import *
sys.path.append("C:\Program Files (x86)\IronPython 2.7\Lib")
#from xml.parsers.expat import expat -- can't find this
import xml.etree.ElementTree as ET
#The inputs to this node will be stored as a list in the IN variables.
xml = IN[0]
xpathstr = IN[1]

root = ET.fromstring(xml)

xpathfound = root.findall(xpathstr)
#xparentstr = xpathstr + "/.."
#xparentfound = root.findall(xpathstr+"/..")
xtags, xtext, xcountattrib, xattrib, xattvals, xcountiter, xitertags, xitervals, xparents = [], [], [], [], [], [], [], [], []
for x in xpathfound:
	xtags.append(x.tag)
	if x.text:
		try:
			xtext.append(x.text)
		except:
			xtext.append("_none_")
	else:
		xtext.append("_none_")
	if x.keys():
		xcountattrib.append(len(x.items()))
		for name, value in x.items():
			xattrib.append(name)
			xattvals.append(value)
#PARENT CODE BELOW IS TOO SLOW
#			try:
#				xparents.append(root.find(xpathstr + "/" + name + "/.."))
#			except:
#				xparents.append("no parent found")
	else:
		xcountattrib.append(1)
		xattrib.append("_none_")
		xattvals.append("_none_")

#THIS METHOD NOT GREAT
#	if x.iter():
#		xcountiter.append(len(x.iter()))
#		for name, value in x.iter():
#			xitertags.append(name)
#			xitervals.append(value)
#for y in xparentfound:
#	xparents.append(y.tag)

OUT = root, str(root), xpathfound, xtags, xtext, xcountattrib, xattrib, xattvals
#, xparents 
#, xparentfound#, xparents#, xcountiter, xitertags, xitervals
# ----------------------------------------
getItemAtIndex = List.GetItemAtIndex(list=python_script, index=code_block)

# group (continued): PLACE TEXTNOTE FOR KADASTRAAL PERCEEL
flatten = List.Flatten(list=getItemAtIndex)
toNumber = String.ToNumber(str=flatten)
add = DeltaX + toNumber

python_script_2 = Python(IN[0]=web_request, IN[1]=string_2)  # same code as python_script
getItemAtIndex_2 = List.GetItemAtIndex(list=python_script_2, index=code_block_2)

# group (continued): PLACE TEXTNOTE FOR KADASTRAAL PERCEEL
flatten_2 = List.Flatten(list=getItemAtIndex_2)
toNumber_2 = String.ToNumber(str=flatten_2)
add_2 = DeltaY + toNumber_2
createPointFromGML = Custom[GIS2BIM.CreatePointFromGML](XML=web_request, ModX=add, ModY=add_2, UnitsConversionFactor=code_block_3)  # package GIS2BIM for Dynamo 2.x; Create Points from space seperated GML

python_script_3 = Python(IN[0]=web_request, IN[1]=string_3)  # same code as python_script
getItemAtIndex_3 = List.GetItemAtIndex(list=python_script_3, index=code_block_4)

# group (continued): PLACE TEXTNOTE FOR KADASTRAAL PERCEEL
flatten_3 = List.Flatten(list=getItemAtIndex_3)

string_5 = StringInput(".//{http://kadastralekaartv3.geonovum.nl}perceelnummer_rotatie")  # graph input
python_script_4 = Python(IN[0]=web_request, IN[1]=string_5)  # same code as python_script
code_block_5 = CodeBlock { 4; }
getItemAtIndex_4 = List.GetItemAtIndex(list=python_script_4, index=code_block_5)

# group (continued): PLACE TEXTNOTE FOR KADASTRAAL PERCEEL
flatten_4 = List.Flatten(list=getItemAtIndex_4)
flatten_5 = List.Flatten(list=flatten_4)
toNumber_3 = String.ToNumber(str=flatten_5)
byLocation = TextNote.ByLocation(view=view, location=createPointFromGML, text=flatten_3, alignment=string_4, type=byName, rotation=toNumber_3)
