# Dynamo graph Czech Republic Cadastre.dyn (Dynamo 1.3.3.4111)

code_block = CodeBlock { "5514"; }
searchCRS = Custom[GIS2BIM.SearchCRS](EPSG_Code=code_block)  # Search for a Coordinate Reference System
code_block_2 = CodeBlock { Application.Document.Current.ActiveView; }
code_block_3 = CodeBlock { "4326"; }
code_block_4 = CodeBlock { "14.42"; "50.087"; }
transformCRS_epsg = Custom[GIS2BIM.TransformCRS_epsg](sourceCRS=code_block_3, targetCRS=code_block, xCoordinate=code_block_4.out0, yCoordinate=code_block_4.out1)  # Uses the API of http://epsg.io to transform Coordinate Reference Systems
boundingboxWidth = CodeBlock { 200; }
createBoundingBox = Custom[GIS2BIM.CreateBoundingBox](CoordinateX=transformCRS_epsg.Xtransformed, CoordinateY=transformCRS_epsg.Ytransformed, BoxWidth=boundingboxWidth, BoxHeight=boundingboxWidth)  # create boundingboxstring for webrequests based on coördinates and dimensions
czechRepublicGeoservicesLibrary = Custom[GIS2BIM.CzechRepublicGeoservicesLibrary](Boundingboxstring=createBoundingBox.Boxstring)  # Geoservices in the Czech Republic
code_block_5 = CodeBlock { "Thin Lines"; "Hidden Lines"; }

# group: CADASTRE PARCELS
web_request = WebRequest(czechRepublicGeoservicesLibrary.Cadastral_Parcel_OGC_WFS)
createPointsPolygonFromGMLxy = Custom[GIS2BIM.CreatePointsPolygonFromGMLxy](XML=web_request, DeltaX=transformCRS_epsg.Xtransformed, DeltaY=transformCRS_epsg.Ytransformed)  # Create point and polygons from a GML-file
createDetailLinesFromPolygons = Custom[GIS2BIM.CreateDetailLinesFromPolygons](View=code_block_2, PolyCurves=createPointsPolygonFromGMLxy.PolyCurves, Linestyle=code_block_5.out1)  # frozen; Create detaillines from polygons in a view

code_block_6 = CodeBlock { "Center"; }
