# Dynamo graph Kadaster BAG.dyn (Dynamo 1.3.1.1736)

# group: INPUT
boundingboxwidth_m = CodeBlock { 250; }
code_block = CodeBlock { "2.5 mm"; "3.5 mm"; "2.5 mm zwart"; }
lineStyleKadaster = CodeBlock { "kadastrale_grens"; }
lineStyleBAGPand = StringInput("pen rood")

getSharedCoordinate = Custom[GIS2BIM.GetSharedCoordinate]()  # Get the current shared coordinate
current = Document.Current()
activeView = Document.ActiveView(current)
boundingbox = CodeBlock { 250; }
createBoundingBox = Custom[GIS2BIM.CreateBoundingBox](CoordinateX=getSharedCoordinate.RdxMeters, CoordinateY=getSharedCoordinate.RdyMeters, BoxWidth=boundingbox, BoxHeight=boundingbox)  # create boundingboxstring for webrequests based on coördinates and dimensions
geoservicesLibraryNetherlands = Custom[GIS2BIM.GeoservicesLibraryNetherlands](BoundingBox=createBoundingBox)  # Library with multiple webadresses which can be used for WFS and WMS webrequests

# group: KADASTER ANNOTATION
kadasterPercelen = Custom[GIS2BIM.KadasterPercelen](DeltaX=getSharedCoordinate.RdxMeters, DeltaY=getSharedCoordinate.RdyMeters, View=activeView, TextTypePerceel=code_block.out2, UrlWebrequestKadasterPerceel=geoservicesLibraryNetherlands.8_kadastrale_perceel)  # Draw propertylines and place streetnames and housenumbers from the dutch kadaster
kadasterHouseNumbers = Custom[GIS2BIM.KadasterHouseNumbers](UrlWebrequestKadasterAnnotation=geoservicesLibraryNetherlands.7_kadastrale_annotatie, DeltaX=getSharedCoordinate.RdxMeters, DeltaY=getSharedCoordinate.RdyMeters, View=activeView, TextTypeHousenumber=code_block.out0, TextTypeStreetname=code_block.out1)  # Draw propertylines and place streetnames and housenumbers from the dutch kadaster

string = StringInput(".//{http://www.opengis.net/gml/3.2}posList")
boolean = BoolSelector(false)

# group: KADASTRALE PERCELEN(GRENZEN)
web_request = WebRequest(geoservicesLibraryNetherlands.1_kadastrale_grenzen_WFS)
createPointsPolygonFromGMLxy = Custom[GIS2BIM.CreatePointsPolygonFromGMLxy](XML=web_request, XPATHSTRING=string, DeltaX=getSharedCoordinate.RdxMeters, DeltaY=getSharedCoordinate.RdyMeters, Connectpolygon=boolean)  # Create point and polygons from a GML-file
createDetailLinesFromPolygons = Custom[GIS2BIM.CreateDetailLinesFromPolygons](View=activeView, PolyCurves=createPointsPolygonFromGMLxy.PolyCurves, Linestyle=lineStyleKadaster)  # Create detaillines from polygons in a view

filledregiontypebag_pand = FilledRegionTypes("FP_DP_90_pand")

# group: BAG: pand
web_request_2 = WebRequest(geoservicesLibraryNetherlands.4_bag_pand_WFS)
boolean_2 = BoolSelector(true)
createPointsPolygonFromGMLxyz = Custom[GIS2BIM.CreatePointsPolygonFromGMLxyz](XML=web_request_2, XPATHSTRING=string, DeltaX=getSharedCoordinate.RdxMeters, DeltaY=getSharedCoordinate.RdyMeters, Connectpolygon=boolean_2)  # Create points and polygons from a xml/gml-file with x,y and z value
createDetailLinesFromPolygons_2 = Custom[GIS2BIM.CreateDetailLinesFromPolygons](View=activeView, PolyCurves=createPointsPolygonFromGMLxyz.PolyCurves, Linestyle=lineStyleBAGPand)
explode = Geometry.Explode(createPointsPolygonFromGMLxyz.PolyCurves)
byCurves = FilledRegion.ByCurves(activeView, explode, filledregiontypebag_pand)
