# Dynamo graph ExampleGML.dyn (Dynamo 1.3.1.1736)

string = StringInput(".//{http://www.opengis.net/gml}posList")
code_block = CodeBlock { "Boskoop"; "Warmoeskade"; "2"; }
getLocationdataNetherlands = Custom[GIStoBIM.GetLocationdataNetherlands](city=code_block.out0, streetname=code_block.out1, housenumber=code_block.out2)  # Gives locationdata based on an adress in the Netherlands
code_block_2 = CodeBlock { 200; }
boolean = BoolSelector(false)
filterGML = Custom[GIStoBIM.FilterGML](xPATH=string, coordinateX=getLocationdataNetherlands.RDcoordinate_X_meters, coordinateY=getLocationdataNetherlands.RDcoordinate_Y_meters, boundingbox=code_block_2, connectpolycurves=boolean)  # filter GML-file based on boundingbox; unwired: gmlFile
getMortonCodeCoordinate = Custom[GIStoBIM.GetMortonCodeCoordinate](X=getLocationdataNetherlands.RDcoordinate_X_meters, Y=getLocationdataNetherlands.RDcoordinate_Y_meters)  # Get mortoncode given 2 coordinates and tiledimension
downloadBGTdata = Custom[GIStoBIM.DownloadBGTdata]()  # Download BGT-data(dutch GIS-information); unwired: mortoncode, directory
directory_path = Directory("C:\TEMP")
