# Dynamo graph AHN3.dyn (Dynamo 1.3.3.4111)

code_block = CodeBlock { "boskoop"; "warmoeskade"; "2"; }
getLocationdataNetherlands = Custom[GIS2BIM.GetLocationdataNetherlands](City=code_block.out0, Streetname=code_block.out1, Housenumber=code_block.out2)  # Gives locationdata based on an adress in the Netherlands
code_block_2 = CodeBlock { 6000; }
createBoundingBox = Custom[GIS2BIM.CreateBoundingBox](CoordinateX=getLocationdataNetherlands.RDcoordinateX_meters_double, CoordinateY=getLocationdataNetherlands.RDcoordinateY_meters_double, BoxWidth=code_block_2, BoxHeight=code_block_2)  # create boundingboxstring for webrequests based on coördinates and dimensions
geoservicesLibraryNetherlands = Custom[GIS2BIM.GeoservicesLibraryNetherlands](BoundingBox=createBoundingBox.Boxstring)  # Library with multiple webadresses which can be used for WFS and WMS webrequests
downloadAHN = Custom[GIS2BIM.DownloadAHN](UrlwebrequestAHN2=geoservicesLibraryNetherlands.11_AHN2_webrequest_bladindex_OGC_WFS, UrlwebrequestAHN3=geoservicesLibraryNetherlands.AHN3_webrequest_bladindex_OGC_WFS)  # get the mapnumber(s) of the AHN based on a given boundingbox
openBrowser = Custom[GIS2BIM.OpenBrowser]()  # Opens a new window in your default browser with the given url.; unwired: url
web_request = WebRequest(getLocationdataNetherlands.URLWebrequest)
code_block_3 = CodeBlock()
# ---------- code_block_3.designscript (5 lines) ----------
"http://geodata.nationaalgeoregister.nl/ahn2/wfs?";
"&request=GetFeature";
"&typeName=ahn2_bladindex";
"&outputformat=JSON";
"&bbox=";
# ----------------------------------------
code_block_4 = CodeBlock(bbox=createBoundingBox.Boxstring) { bbox; }
concat = String.Concat(code_block_3.out0, code_block_3.out1, code_block_3.out2, code_block_3.out3, code_block_3.out4, code_block_4)
web_request_2 = WebRequest(concat)
code_block_5 = CodeBlock()
# ---------- code_block_5.designscript (5 lines) ----------
"http://geodata.nationaalgeoregister.nl/ahn3/wfs?";
"&request=GetFeature";
"&typeName=ahn3_bladindex";
"&outputformat=JSON";
"&bbox=";
# ----------------------------------------
concat_2 = String.Concat(code_block_5.out0, code_block_5.out1, code_block_5.out2, code_block_5.out3, code_block_5.out4, code_block_4)
web_request_3 = WebRequest(concat_2)
code_block_6 = CodeBlock { id; min_datum; max_datum; bladnr; cellsize; datum; lo_x; lo_y; }  # unwired: id, min_datum, max_datum, bladnr, cellsize, datum, lo_x, lo_y
code_block_7 = CodeBlock { id; bladnr; cellsize; lo_x; lo_y; }  # unwired: id, bladnr, cellsize, lo_x, lo_y
code_block_8 = CodeBlock { 0; }
getItemAtIndex = List.GetItemAtIndex(index=code_block_8)  # unwired: list
importImageInView = Custom[GIS2BIM.ImportImageInView]()  # Import rasterimage in view; unwired: ImageWidthMeters, View, ImagePath
downloadAHN_2 = Custom[GIS2BIM.DownloadAHN]()  # unwired: UrlwebrequestAHN2
watch = Watch()  # unwired: arg0
web_request_4 = WebRequest(geoservicesLibraryNetherlands.AHN3_webrequest_bladindex_OGC_WFS)
code_block_9 = CodeBlock()
# ---------- code_block_9.designscript (7 lines) ----------
//XPATHSTRINGS
".//{http://ahn3.geonovum.nl}ahn3_bladindex";
".//{http://ahn3.geonovum.nl}bladnr";
".//{http://ahn3.geonovum.nl}cellsize";
".//{http://ahn3.geonovum.nl}lo_x";
".//{http://ahn3.geonovum.nl}lo_y";
".//{http://ahn3.geonovum.nl}has_data";
# ----------------------------------------
create = List.Create(code_block_9.out0, code_block_9.out1, code_block_9.out2, code_block_9.out3, code_block_9.out4, code_block_9.out5)
XMLXPath = Custom[GIS2BIM.XMLXPath](XMLString=web_request_4, XPathStrings=create)  # Run an XPathquery on an xml-string
code_block_10 = CodeBlock(output=XMLXPath) { output; }
web_request_5 = WebRequest()  # unwired: arg0
code_block_11 = CodeBlock()
# ---------- code_block_11.designscript (11 lines) ----------
//XPATHSTRINGS
".//{http://ahn2.geonovum.nl}ahn2_bladindex";
".//{http://ahn2.geonovum.nl}bladnr";
".//{http://ahn2.geonovum.nl}update";
".//{http://ahn2.geonovum.nl}min_datum";
".//{http://ahn2.geonovum.nl}max_datum";
".//{http://ahn2.geonovum.nl}cellsize";
".//{http://ahn2.geonovum.nl}lo_x";
".//{http://ahn2.geonovum.nl}lo_y";
".//{http://ahn2.geonovum.nl}datum";
".//{http://ahn2.geonovum.nl}geom_valid";
# ----------------------------------------
create_2 = List.Create(code_block_11.out0, code_block_11.out1, code_block_11.out2, code_block_11.out3, code_block_11.out4, code_block_11.out5, code_block_11.out6, code_block_11.out7, code_block_11.out8, code_block_11.out9)
XMLXPath_2 = Custom[GIS2BIM.XMLXPath](XMLString=web_request_5, XPathStrings=create_2)
code_block_12 = CodeBlock(output=XMLXPath_2) { output; }
XMLXPath_3 = Custom[GIS2BIM.XMLXPath]()  # unwired: XMLString, XPathStrings
code_block_13 = CodeBlock { 1; }
getItemAtIndex_2 = List.GetItemAtIndex(list=XMLXPath_3, index=code_block_13)
create_3 = List.Create(getItemAtIndex_2)
toUpper = String.ToUpper(create_3)
code_block_14 = CodeBlock()
# ---------- code_block_14.designscript (3 lines) ----------
"http://geodata.nationaalgeoregister.nl/ahn2/extract/ahn2_gefilterd/u";
"http://geodata.nationaalgeoregister.nl/ahn2/extract/ahn2_uitgefilterd/u";
"https://geodata.nationaalgeoregister.nl/ahn3/extract/ahn3_laz/C_";
# ----------------------------------------
code_block_15 = CodeBlock { ".laz.zip"; ".LAZ"; }
concat_3 = String.Concat(code_block_14.out2, arg2=code_block_15.out1)  # unwired: arg1
map = List.Map(list=toUpper, f_x=concat_3)
concat_4 = String.Concat(code_block_14.out0, arg2=code_block_15.out0)  # unwired: arg1
map_2 = List.Map(list=getItemAtIndex_2, f_x=concat_4)
concat_5 = String.Concat(code_block_14.out1, arg2=code_block_15.out0)  # unwired: arg1
map_3 = List.Map(list=getItemAtIndex_2, f_x=concat_5)
openBrowser_2 = Custom[GIS2BIM.OpenBrowser](url=geoservicesLibraryNetherlands.11_AHN2_webrequest_bladindex_OGC_WFS)
getPointsFromBoxSelection = Custom[PointCloud.GetPointsFromBoxSelection]()  # WIP: collects the points from a point cloud instance by using a box shape collector (aka a Revit element such as a Mass). Mass geometry has to be a box (parallel faces). The number of points read must range from 1 to 1000000. Default 50000. Average Distance is a setting for PC density. Less distance increases the number of points.; unwired: Point_Cloud_Instance, Box
web_request_6 = WebRequest(geoservicesLibraryNetherlands.11_AHN2_webrequest_bladindex_OGC_WFS)
python_script = Python(IN[0]=web_request_6, IN[1]=create_2)
# ---------- python_script.python (27 lines) ----------
import clr
clr.AddReference('ProtoGeometry')
from Autodesk.DesignScript.Geometry import *

import sys
sys.path.append("C:\Program Files (x86)\IronPython 2.7\Lib")

import xml.etree.ElementTree as ET
xml = IN[0]
xpathlist = IN[1]

root = ET.fromstring(xml)

xpathfounds = []

for i in xpathlist:
	xpathfounds.append(root.findall(i))
	
xpathfoundtext = []
for i in xpathfounds:
	for j in i:
			try: xpathfoundtext.append(j.text)
			except: xpathfoundtext.append("_none")
#	else:
#		xpathfoundtext.append("_none")
		
OUT = xpathfounds
# ----------------------------------------
python_script_2 = Python(IN[0]=web_request_6, IN[1]=code_block_11.out0)
# ---------- python_script_2.python (51 lines) ----------
import clr
import sys
clr.AddReference('ProtoGeometry')
from Autodesk.DesignScript.Geometry import *
sys.path.append("C:\Program Files (x86)\IronPython 2.7\Lib")
#from xml.parsers.expat import expat -- can't find this
import xml.etree.ElementTree as ET
#The inputs to this node will be stored as a list in the IN variables.
xml = IN[0]
xpathstr = IN[1]

root = ET.fromstring(xml)

xpathfound = root.findall(xpathstr)
#xparentstr = xpathstr + "/.."
#xparentfound = root.findall(xpathstr+"/..")
xtags, xtext, xcountattrib, xattrib, xattvals, xcountiter, xitertags, xitervals, xparents = [], [], [], [], [], [], [], [], []
for x in xpathfound:
	xtags.append(x.tag)
	if x.text:
		try:
			xtext.append(x.text)
		except:
			xtext.append("_none_")
	else:
		xtext.append("_none_")
	if x.keys():
		xcountattrib.append(len(x.items()))
		for name, value in x.items():
			xattrib.append(name)
			xattvals.append(value)
#PARENT CODE BELOW IS TOO SLOW
#			try:
#				xparents.append(root.find(xpathstr + "/" + name + "/.."))
#			except:
#				xparents.append("no parent found")
	else:
		xcountattrib.append(1)
		xattrib.append("_none_")
		xattvals.append("_none_")

#THIS METHOD NOT GREAT
#	if x.iter():
#		xcountiter.append(len(x.iter()))
#		for name, value in x.iter():
#			xitertags.append(name)
#			xitervals.append(value)
#for y in xparentfound:
#	xparents.append(y.tag)

OUT = root, str(root), xpathfound, xtags, xtext, xcountattrib, xattrib, xattvals
# ----------------------------------------
