# Dynamo graph AHN_CloudCompare.dyn (Dynamo 1.3.1.1736)

# group: INPUT
directory_laszip = CodeBlock { "C:/TEMP"; }
filepath_laz_pointcloud = Filename("..\..\..\..\..\..\..\TEMP\C_38AN2.LAZ")
boundingbox = CodeBlock { 150; }
new_filename = CodeBlock { "00_cropped.laz"; }

getSharedCoordinate = Custom[GIS2BIM.GetSharedCoordinate]()  # Get the current shared coordinate

# group: CREATE BATCHFILE
code_block = CodeBlock { "/"; "cropped3.bat"; }
concat = String.Concat(directory_laszip, code_block.out0, code_block.out1)
downloadLASZIP = Custom[GIS2BIM.DownloadLASZIP](Directory=directory_laszip)  # download and unzip laszip
code_block_2 = CodeBlock { " -i "; }
code_block_3 = CodeBlock { "-keep_classification 2 "; ""; " -oparse xyz"; }
string = StringInput("\"")
code_block_4 = CodeBlock { " -translate_x -"; " -translate_y -"; }
code_block_5 = CodeBlock(x=getSharedCoordinate.E_W, y=getSharedCoordinate.N_S, width=boundingbox) { x; y; width; }
toString = Custom[Springs.Number.ToString](num=code_block_5.x)  # Converts the input number(s) to string. You can optionally limit the number of digits.
toString_2 = Custom[Springs.Number.ToString](num=code_block_5.y)
code_block_6 = CodeBlock { " -inside "; " "; }
code_block_7 = CodeBlock(x=code_block_5.x, bbox=code_block_5.width, y=code_block_5.y) { x-0.5*bbox; x+0.5*bbox; y-0.5*bbox; y+0.5*bbox; }
toString_3 = Custom[Springs.Number.ToString](num=code_block_7.out0)
toString_4 = Custom[Springs.Number.ToString](num=code_block_7.out2)
toString_5 = Custom[Springs.Number.ToString](num=code_block_7.out1)
toString_6 = Custom[Springs.Number.ToString](num=code_block_7.out3)
code_block_8 = CodeBlock { " -odir "; " -o "; }
string_2 = StringInput("\"")
concat_2 = String.Concat(downloadLASZIP.Laszip, code_block_2, code_block_3.out1, string, filepath_laz_pointcloud, string, code_block_4.out0, toString, code_block_4.out1, toString_2, code_block_6.out0, toString_3, code_block_6.out1, toString_4, code_block_6.out1, toString_5, code_block_6.out1, toString_6, code_block_8.out0, string, directory_laszip, string, code_block_8.out1, string_2, new_filename, string_2)
writeToFile = CSV.WriteToFile(concat, concat_2)

createBoundingBox = Custom[GIS2BIM.CreateBoundingBox](CoordinateX=getSharedCoordinate.E_W, CoordinateY=getSharedCoordinate.N_S, BoxWidth=boundingbox, BoxHeight=boundingbox)  # create boundingboxstring for webrequests based on coördinates and dimensions
geoservicesLibraryNetherlands = Custom[GIS2BIM.GeoservicesLibraryNetherlands](BoundingBox=createBoundingBox.Boxstring)  # Library with multiple webadresses which can be used for WFS and WMS webrequests
webrequestWMS2 = Custom[GIS2BIM.WebrequestWMS2](WMSwebrequest=geoservicesLibraryNetherlands.5_luchtfoto_2016_WMS)  # a webrequest based on WMS-protocol
watch_image = WatchImageCore(webrequestWMS2)
code_block_9 = CodeBlock { "4326"; }
searchCRS = Custom[GIS2BIM.SearchCRS](EPSG_Code=code_block_9)  # Search for a Coordinate Reference System
code_block_10 = CodeBlock { "28992"; }
getRevitSiteLocation = Custom[GIS2BIM.GetRevitSiteLocation]()  # Gets the properties of the current Site Location of the active Revit Project
string_from_object = FromObject(getRevitSiteLocation.Lon)
code_block_11 = CodeBlock { ","; "."; }
replace = String.Replace(str=string_from_object, searchFor=code_block_11.out0, replaceWith=code_block_11.out1)
string_from_object_2 = FromObject(getRevitSiteLocation.Lat)
replace_2 = String.Replace(str=string_from_object_2, searchFor=code_block_11.out0, replaceWith=code_block_11.out1)
transformCRS_epsg = Custom[GIS2BIM.TransformCRS_epsg](sourceCRS=code_block_9, targetCRS=code_block_10, xCoordinate=replace, yCoordinate=replace_2)  # Uses the API of http://epsg.io to transform Coordinate Reference Systems
searchCRS_2 = Custom[GIS2BIM.SearchCRS](EPSG_Code=code_block_10)
downloadAHN = Custom[GIS2BIM.DownloadAHN](Urlwebrequest=geoservicesLibraryNetherlands.11_AHN2_webrequest_bladindex)  # get the mapnumber(s) of the AHN based on a given boundingbox
openBrowser = Custom[GIS2BIM.OpenBrowser](url=downloadAHN.Downloadlink_AHN2_uitgefilterd)  # frozen; Opens a new window in your default browser with the given url.
openBrowser_2 = Custom[GIS2BIM.OpenBrowser](url=downloadAHN.downloadlink_AHN3)
