# Dynamo graph ArcGISAPI.dyn (Dynamo 1.3.1.1736)

views = Views("Plattegrond Begane Grond")
hawaiGeoservicesLibrary = Custom[GIS2BIM.HawaiGeoservicesLibrary]()  # Library with multiple webadresses which can be used for WFS and WMS webrequests
code_block = CodeBlock { "4326"; "3760"; }
code_block_2 = CodeBlock { "anderson avenue"; "10"; "honolulu"; "hawai"; }
geoCodingGoogleAPI = Custom[GIS2BIM.GeoCodingGoogleAPI](Streetname=code_block_2.out0, Housenumber=code_block_2.out1, Place=code_block_2.out2, Country=code_block_2.out3)  # gets coordinate from adress with google API
transformCRS_epsg = Custom[GIS2BIM.TransformCRS_epsg](sourceCRS=code_block.out0, targetCRS=code_block.out1, x_coordinate=geoCodingGoogleAPI.Longitude, y_coordinate=geoCodingGoogleAPI.Latitude)  # Uses the API of http://epsg.io to transform Coordinate Reference Systems
boundingbox_width_and_height_in = CodeBlock { 2000; }  # "Boundingbox width and height(In surveyFeet)"
createBoundingBox = Custom[GIS2BIM.CreateBoundingBox](CoordinateX=transformCRS_epsg.Xtransformed, CoordinateY=transformCRS_epsg.Ytransformed, BoxWidth=boundingbox_width_and_height_in, BoxHeight=boundingbox_width_and_height_in)  # create boundingboxstring for webrequests based on coördinates and dimensions
arcGIS_REST_API_QUERY = Custom[GIS2BIM.ArcGIS_REST_API_QUERY](WebserverAddress=hawaiGeoservicesLibrary.Hawai_Cadastral_Tax_Parcel, Boundingbox=createBoundingBox.Boxstring2)  # Create query to connect to arcGIS webservers
web_request = WebRequest(arcGIS_REST_API_QUERY)
deserialise = DynaWeb.Helpers.Deserialise(web_request)
arcGISJSONtoPolygons = Custom[GIS2BIM.ArcGISJSONtoPolygons](JSONConvertedToLists=deserialise, X=transformCRS_epsg.Xtransformed, Y=transformCRS_epsg.Ytransformed)  # Convert a JSON-file from a ARCGIS-server to points and polygons
code_block_3 = CodeBlock { "_0.18"; }
createDetailLinesFromPolygons = Custom[GIS2BIM.CreateDetailLinesFromPolygons](View=views, PolyCurves=arcGISJSONtoPolygons.Polycurves, Linestyle=code_block_3)  # Create detaillines from polygons in a view
createBoundingBox_2 = Custom[GIS2BIM.CreateBoundingBox]()  # unwired: CoordinateX, CoordinateY, BoxWidth, BoxHeight
