# Dynamo graph BGT New 3.dyn (Dynamo 2.10.1.3976)
# packages: GIS2BIM for Dynamo 2.x 0.11.19

current = Document.Current()
string = StringInput("\")
string_2 = StringInput("/")

# group: Bepaal actieve view & bestandsnaam
filePath = Document.FilePath(document=current)
replace = String.Replace(string=filePath, searchFor=string, replaceWith=string_2)

code_block = CodeBlock { 400; }

# group: BOUNDINGBOX IN DYNAMO
code_block_2 = CodeBlock(a=code_block) { a*1000; }
byWidthLength = Rectangle.ByWidthLength(width=code_block_2, length=code_block_2)

code_block_3 = CodeBlock { "Gouda"; "gouderaksedijk"; "58"; }
GIS2BIM_GetLocationdataNetherlands = Custom[GIS2BIM_GetLocationdataNetherlands](City=code_block_3.out0, Streetname=code_block_3.out1, Housenumber=code_block_3.out2)  # package GIS2BIM for Dynamo 2.x; Gives locationdata based on an adress in the Netherlands
GIS2BIM_CreateBoundingBox = Custom[GIS2BIM_CreateBoundingBox](CoordinateX=GIS2BIM_GetLocationdataNetherlands.RDcoordinateXmeters, CoordinateY=GIS2BIM_GetLocationdataNetherlands.RDcoordinateYmeters, BoxWidth=code_block, BoxHeight=code_block)  # package GIS2BIM for Dynamo 2.x; create boundingboxstring for webrequests based on coördinates and dimensions
code_block_4 = CodeBlock { "tempfolder_name"; }
GIS2BIM_CompanySettings = Custom[GIS2BIM_CompanySettings](SearchSetting=code_block_4)  # package GIS2BIM for Dynamo 2.x; GIS2BIM Company Settings

# group: make new directory
python_script = Python(IN[0]=filePath, IN[1]=GIS2BIM_CompanySettings.Setting)  # IronPython2
# ---------- python_script.python (12 lines) ----------
import os

revitfilepath = IN[0]
tempfoldername =  IN[1]

NewFolder = os.path.dirname(revitfilepath) + "/" + tempfoldername
if os.path.exists(NewFolder):
	NewFolder
else:
	os.mkdir(NewFolder)

OUT = NewFolder
# ----------------------------------------

code_block_5 = CodeBlock { '\'; "/"; }
replace_2 = String.Replace(string=python_script, searchFor=code_block_5.out0, replaceWith=code_block_5.out1)
code_block_6 = CodeBlock { "BGT"; }
python_script_2 = Python(IN[0]=replace_2, IN[1]=code_block_6)  # IronPython2
# ---------- python_script_2.python (16 lines) ----------
import os
from datetime import datetime

filepath = IN[0]
BGTprefix =  IN[1]

NewFolder = filepath + "/" + BGTprefix 

if os.path.exists(NewFolder):
	NewFolder
else:
	os.mkdir(NewFolder)

zipfile = NewFolder + '.zip'

OUT = NewFolder,zipfile
# ----------------------------------------
code_block_7 = CodeBlock(a=python_script_2) { a[1]; a[0]; }
python_script_3 = Python()  # CPython3
# ---------- python_script_3.python (13 lines) ----------
from System.Reflection import Assembly
import os

dynamo = Assembly.Load('DynamoCore')
version = str(dynamo.GetName().Version)
versionsplit = version.split(".")
version = versionsplit[0] + "." + versionsplit[1]

basepath = os.getenv('APPDATA')

pathRequests = basepath + "/Dynamo/Dynamo Revit/" + version + "/packages/GIS2BIM for Dynamo 2.x/bin"

OUT = pathRequests
# ----------------------------------------

# group: POST/GET/ CUSTOM BGT DOWNLOAD
code_block_8 = CodeBlock { "https://api.pdok.nl/lv/bgt/download/v1_0/full/custom"; }
code_block_9 = CodeBlock { "https://api.pdok.nl"; }
code_block_10 = CodeBlock()
# ---------- code_block_10.designscript (2 lines) ----------
//timeout
120;
# ----------------------------------------
python_script_4 = Python(IN[0]=GIS2BIM_CreateBoundingBox.PolygonString, IN[1]=code_block_8, IN[2]=code_block_9, IN[3]=code_block_10, IN[4]=code_block_7.out0, IN[5]=code_block_7.out1, IN[6]=python_script_3)  # CPython3
# ---------- python_script_4.python (74 lines) ----------
import sys
import clr
import json
import urllib
import time

polygonString = IN[0] #Define format, polygon, layers
url = IN[1]
url2= IN[2]
timeout = IN[3]
folder = IN[4]
folder2 = IN[5]
pathRequestsLibrary = IN[6]

sys.path.append(pathRequestsLibrary)
import requests
from requests.structures import CaseInsensitiveDict

##Define data 
qryPart1 = '{"featuretypes":['
qryPart2 = '"bak","begroeidterreindeel","bord","buurt","functioneelgebied","gebouwinstallatie","installatie","kast","kunstwerkdeel","mast","onbegroeidterreindeel","ondersteunendwaterdeel","ondersteunendwegdeel","ongeclassificeerdobject","openbareruimte","openbareruimtelabel","overbruggingsdeel","overigbouwwerk","overigescheiding","paal","pand","put","scheiding","sensor","spoor","stadsdeel","straatmeubilair","tunneldeel","vegetatieobject","waterdeel","waterinrichtingselement","waterschap","weginrichtingselement","wijk"'
qryPart3 = '],"format":"gmllight","geofilter":"POLYGON('
qryPart4 = polygonString
qryPart5 = ')"}'

data = qryPart1 +  qryPart2 + qryPart3 + qryPart4 + qryPart5
dataquery = data

headers = CaseInsensitiveDict()
headers["accept"] = "application/json"
headers["Content-Type"] = "application/json"

resp = requests.post(url, headers=headers, data=data)

jsondata = json.loads(resp.text)
data = jsondata["downloadRequestId"]
urlstatus = url + "/" + data + "/status" 

# Check URL Status

req = urllib.request.urlopen(urlstatus)
req2 = req.read().decode('utf-8')
progressStatus = int(json.loads(req2)['progress'])

timer = 0

while timer < timeout:
    req = urllib.request.urlopen(urlstatus)
    req2 = req.read().decode('utf-8')    
    progressStatus = int(json.loads(req2)['progress'])
    status = json.loads(req2)['status']
    if status == "COMPLETED":
        try:
            downloadURL = url2 + json.loads(req2)["_links"]["download"]["href"]
        except:   
            downloadURL = "unable to get downloadlink"        
        message = status
        break
    elif timer > timeout:
        downloadURL = "empty"
        message = "timeout"
        break
    else: 
        time.sleep(1)
    timer = timer + 1

#downloadURL = "test"
#message = "test"
req = requests.get(downloadURL, allow_redirects=True)

with open(folder, 'wb') as f:
    f.write(req.content)

OUT = downloadURL, message, urlstatus, folder, folder2, dataquery
# ----------------------------------------

# group: unzip files
code_block_11 = CodeBlock(a=python_script_4) { a[0]; a[1]; a[2]; a[3]; a[4]; a[5]; }
python_script_5 = Python(IN[0]=code_block_11.out3, IN[1]=code_block_11.out4)  # IronPython2
# ---------- python_script_5.python (27 lines) ----------
import clr
import os
clr.AddReference("System.IO.Compression.FileSystem")
from System.IO.Compression import ZipFile
from datetime import datetime

#The inputs to this node will be stored as a list in the IN variables.
dataEnteringNode = IN
tzip = IN[0]
tpath = IN[1]

files = os.listdir(tpath)

filepaths = []
for i in files:
	j = (tpath + "/" + i)
	os.remove(j)

ZipFile.ExtractToDirectory(tzip, tpath)
files = os.listdir(tpath)

filepaths = []
for i in files:
	filepaths.append(tpath + "/" + i)

#Assign your output to the OUT variable.
OUT = tpath, filepaths
# ----------------------------------------
code_block_12 = CodeBlock(a=python_script_5, rdx=GIS2BIM_GetLocationdataNetherlands.RDcoordinateXmeters, rdy=GIS2BIM_GetLocationdataNetherlands.RDcoordinateYmeters) { a[0]; a[1]; rdx; rdy; }

# group: BGT GEOMETRY
GIS2BIM_BGTGeometry = Custom[GIS2BIM_BGTGeometry](RdY=code_block_12.rdy, BoundingboxWidth=code_block, RdX=code_block_12.rdx, Directorypath=code_block_12.out0)  # package GIS2BIM for Dynamo 2.x; Returns BGT-curves and metadata(Dutch GEO)

views = Views("Situatietekening")
code_block_13 = CodeBlock(view=views) { view: var[]..[]; }

# group: BGT DETAILLINES
python_script_6 = Python(IN[0]=GIS2BIM_BGTGeometry.Curves_BGT, IN[1]=code_block_13, IN[2]=GIS2BIM_BGTGeometry.Curvenames_BGT)  # IronPython2
# ---------- python_script_6.python (68 lines) ----------
import clr
clr.AddReference('RevitAPI')
from Autodesk.Revit.DB import *

clr.AddReference("RevitNodes")
import Revit
clr.ImportExtensions(Revit.GeometryConversion)

clr.AddReference("RevitServices")
import RevitServices
from RevitServices.Persistence import DocumentManager
from RevitServices.Transactions import TransactionManager

doc = DocumentManager.Instance.CurrentDBDocument
polycurves = IN[0]

curves = []
#for i in polycurves:
#	for j in i:
#		curves.append(UnwrapElement(j))
	
view = UnwrapElement(IN[1])
linetypes = IN[2]

test = polycurves[0]
test2 = []
for i in test:
	for j in i:
		test2.append(UnwrapElement(j))
		
def mainfunction(polycurve, linetype):
	curves = []
	for i in polycurve:
		for j in i:
			curves.append(UnwrapElement(j))
			
	elementlist = []

	collector = FilteredElementCollector(doc)
	lstFilter = ElementClassFilter(GraphicsStyle)
	lstCollector = collector.WherePasses(lstFilter).ToElements()
	try:
		lstCollector = filter(lambda x: x.Name == linetype, lstCollector)
		linetype = filter(lambda x: x.GraphicsStyleCategory.CategoryType.__str__()=='Model', lstCollector)[0]
	except:
		linetype = []

	TransactionManager.Instance.EnsureInTransaction(doc)
	if doc.IsFamilyDocument: 
		doc_create = doc.FamilyCreate
	else: 
		doc_create = doc.Create
	for curve in curves:
		detcurve = doc_create.NewDetailCurve(view, curve.ToRevitType())
		if linetype != []: 
			detcurve.LineStyle = linetype
		elementlist.append(detcurve)
	TransactionManager.Instance.TransactionTaskDone()
	return  elementlist

result = []
for i,j in zip(polycurves,linetypes):
	try:
		result.append(mainfunction(i,j))
	except: result.append("_none_")

	
OUT = result
# ----------------------------------------

# group: PLACE OPENBARE RUIMTE LABEL
toUpper = String.ToUpper(string=GIS2BIM_BGTGeometry.Text_openbareruimtelabel)
code_block_14 = CodeBlock { "left"; }
code_block_15 = CodeBlock { "3.5 mm"; }
byName = TextNoteType.ByName(name=code_block_15)
toNumber = String.ToNumber(str=GIS2BIM_BGTGeometry.Rotation_openbareruimtelabel)
code_block_16 = CodeBlock(a=toNumber) { a*-1; }
byLocation = TextNote.ByLocation(view=code_block_13, location=GIS2BIM_BGTGeometry.Points_openbareruimtelabel, text=toUpper, alignment=code_block_14, type=byName, rotation=code_block_16)

# group: BGT VEGATATIEOBJECT
code_block_17 = CodeBlock()
# ---------- code_block_17.designscript (11 lines) ----------
straal = 1500;
straalstam = 100;
line1 = Line.ByStartPointEndPoint(Point.ByCoordinates(Neg(straal), 0), Point.ByCoordinates(straal, 0));
circle1 = Circle.ByCenterPointRadius(Point.Origin(), straal);
circle2 = Circle.ByCenterPointRadius(Point.Origin(), straalstam);
n = (0..1..#15);
point1 = Autodesk.Curve.PointAtParameter(circle1, n);
vector1 = Autodesk.Curve.NormalAtParameter(circle1, n);
line2 = Line.ByStartPointDirectionLength(point1, vector1, straal);
t1 = [circle1, circle2];
t2 = List.Join([t1, line2]);
# ----------------------------------------
code_block_18 = CodeBlock(bgtpoint=GIS2BIM_BGTGeometry.Points_BGT, bgtdata=GIS2BIM_BGTGeometry.Metadata_BGT)
# ---------- code_block_18.designscript (3 lines) ----------
//boomdata
bgtpoint[8];
bgtdata[8];
# ----------------------------------------
X = Point.X(point=code_block_18.out0)
Y = Point.Y(point=code_block_18.out0)
translate = Geometry.Translate(xTranslation=X, yTranslation=Y)  # unwired: geometry
map = List.Map(list=code_block_17.t2, function=translate)
flatten = List.Flatten(list=map)
code_block_19 = CodeBlock { "bgt_vegatatieobject"; }
GIS2BIM_CreateDetailLinesFromPolygons = Custom[GIS2BIM_CreateDetailLinesFromPolygons](view=code_block_13, PolyCurves=flatten, Linestyle=code_block_19)  # package GIS2BIM for Dynamo 2.x; Create detaillines from polygons in a view

# group: FILLED REGION BGT PAND
code_block_20 = CodeBlock(bgtpand=GIS2BIM_BGTGeometry.Curves_BGT) { bgtpand[11]; }
code_block_21 = CodeBlock { "FP_DP_90_pand"; }
byName_2 = FilledRegionType.ByName(name=code_block_21)
byCurves = FilledRegion.ByCurves(view=code_block_13, boundary=code_block_20, regionType=byName_2)

code_block_22 = CodeBlock { t3 = List.FirstItem(t2@@L2<1>); t1 = [[0]]; t4 = List.LastItem(t2@@L2<1>); }  # unwired: t2
python_script_7 = Python(IN[0]=code_block_22.t3, IN[1]=code_block_22.t1)  # IronPython2
# ---------- python_script_7.python (8 lines) ----------
items = IN[0]
rep = IN[1]
elementlist = list()
for item in items:
	if item is None: 
		item = rep
	elementlist.append(item)
OUT = elementlist
# ----------------------------------------
python_script_8 = Python(IN[0]=code_block_22.t4, IN[1]=code_block_22.t1)  # IronPython2; same code as python_script_7
