# Dynamo graph LibTiff.net.dyn (Dynamo 1.3.4.6666)

code_block = CodeBlock { "C:/TEMP/cea2.tiff"; }
code_block_2 = CodeBlock { "C:/TEMP/AHN/m5_65az2.tif"; }
code_block_3 = CodeBlock { "r"; }
open = BitMiracle.LibTiff.Classic.Tiff.Open(code_block_2, code_block_3)
code_block_4 = CodeBlock { 1; }
getTagListEntry = BitMiracle.LibTiff.Classic.Tiff.GetTagListEntry(open, code_block_4)
getField = BitMiracle.LibTiff.Classic.Tiff.GetField(open, getTagListEntry)
getTagListCount = BitMiracle.LibTiff.Classic.Tiff.GetTagListCount(open)
readDirectory = BitMiracle.LibTiff.Classic.Tiff.ReadDirectory(open)
tileSize = BitMiracle.LibTiff.Classic.Tiff.TileSize(open)
getMode = BitMiracle.LibTiff.Classic.Tiff.GetMode(open)
getStream = BitMiracle.LibTiff.Classic.Tiff.GetStream(open)
readBufferSetup = BitMiracle.LibTiff.Classic.Tiff.ReadBufferSetup()  # unwired: arg0, arg1, arg2
readScanline = BitMiracle.LibTiff.Classic.Tiff.ReadScanline(open)  # unwired: arg1, arg2
GEOTIFF_MODELPIXELSCALETAG = BitMiracle.LibTiff.Classic.TiffTag.GEOTIFF_MODELPIXELSCALETAG()
GEOTIFF_MODELTIEPOINTTAG = BitMiracle.LibTiff.Classic.TiffTag.GEOTIFF_MODELTIEPOINTTAG()
tiffTagMethods = BitMiracle.LibTiff.Classic.TiffTagMethods.TiffTagMethods()
GEOTIFF_MODELTRANSFORMATIONTAG = BitMiracle.LibTiff.Classic.TiffTag.GEOTIFF_MODELTRANSFORMATIONTAG()
getField_2 = BitMiracle.LibTiff.Classic.TiffTagMethods.GetField(tiffTagMethods, open, GEOTIFF_MODELTRANSFORMATIONTAG)
code_block_5 = CodeBlock { 1; 2; }
readScanline_2 = BitMiracle.LibTiff.Classic.Tiff.ReadScanline(open, code_block_5.out0, code_block_5.out1)
code_block_6 = CodeBlock()
# ---------- code_block_6.designscript (11 lines) ----------
"http://geodata.nationaalgeoregister.nl/";
"ahn2/wms?";
"&request=GetMap";
"&VERSION=1.3.0";
"&STYLES=default";
"&bbox=";
"&width=3000";
"&height=3000";
"&format=image/GeoTIFF";
"&crs=EPSG:28992";
"&layers=ahn3_05m_dsm";
# ----------------------------------------
code_block_7 = CodeBlock { "boskoop"; "warmoeskade"; "2"; }
getLocationdataNetherlands = Custom[GIS2BIM.GetLocationdataNetherlands](City=code_block_7.out0, Streetname=code_block_7.out1, Housenumber=code_block_7.out2)  # Gives locationdata based on an adress in the Netherlands
code_block_8 = CodeBlock { 500; }
createBoundingBox = Custom[GIS2BIM.CreateBoundingBox](CoordinateX=getLocationdataNetherlands.RDcoordinateX_meters_double, CoordinateY=getLocationdataNetherlands.RDcoordinateY_meters_double, BoxWidth=code_block_8, BoxHeight=code_block_8)  # create boundingboxstring for webrequests based on coördinates and dimensions
concat = String.Concat(code_block_6.out0, code_block_6.out1, code_block_6.out2, code_block_6.out3, code_block_6.out4, code_block_6.out5, createBoundingBox.Boxstring, code_block_6.out6, code_block_6.out7, code_block_6.out8, code_block_6.out9, code_block_6.out10)
webrequestWMS2 = Custom[GIS2BIM.WebrequestWMS2](WMSwebrequest=concat)  # a webrequest based on WMS-protocol
code_block_9 = CodeBlock { "C:/TEMP/test4.tif"; }
systemDrawingBitmapToJPG = Custom[GIS2BIM.SystemDrawingBitmapToJPG](SystemDrawingBitmap=webrequestWMS2, FileName=code_block_9)  # frozen; Save an System.Drawing.Bitmap object as a jpg-file
