# Dynamo graph TiffBitmapDecoder GDAL Libtiff.dyn (Dynamo 1.3.4.6666)

boolean = BoolSelector(true)
python_script = Python(IN[0]=boolean)  # frozen
# ---------- python_script.python (34 lines) ----------
import clr
clr.AddReference('gdal_csharp')

from OSGeo.GDAL import Gdal
from System import Environment
from System.IO import Path

#The inputs to this node will be stored as a list in the IN variables.
dataEnteringNode = IN

gdalPath = "C:\\temp_folder\\new\\GDAL.NET.Core.2.3.1\\gdal"
nativePath = gdalPath + "\\x64"

path = Environment.GetEnvironmentVariable("PATH")
path = nativePath + ";" + Path.Combine(nativePath, "plugins") + ";" + path
Environment.SetEnvironmentVariable("PATH", path)

gdalData = Path.Combine(gdalPath, "data")
Environment.SetEnvironmentVariable("GDAL_DATA", gdalData)
Gdal.SetConfigOption("GDAL_DATA", gdalData)

driverPath = Path.Combine(nativePath, "plugins");
Environment.SetEnvironmentVariable("GDAL_DRIVER_PATH", driverPath)
Gdal.SetConfigOption("GDAL_DRIVER_PATH", driverPath)

Environment.SetEnvironmentVariable("GEOTIFF_CSV", gdalData)
Gdal.SetConfigOption("GEOTIFF_CSV", gdalData)

projSharePath = Path.Combine(gdalPath, "share")
Environment.SetEnvironmentVariable("PROJ_LIB", projSharePath)
Gdal.SetConfigOption("PROJ_LIB", projSharePath)

#Assign your output to the OUT variable.
OUT = Gdal.VersionInfo("")
# ----------------------------------------
watch = Watch(python_script)
code_block = CodeBlock { "C:/TEMP/test3.tif"; }
GA_ReadOnly = OSGeo.GDAL.Access.GA_ReadOnly()
open = OSGeo.GDAL.Gdal.Open(code_block, GA_ReadOnly)
code_block_2 = CodeBlock { "C:/TEMP/cea.tif"; }
code_block_3 = CodeBlock { "C:/TEMP/test.tiff"; }
code_block_4 = CodeBlock { "C:/TEMP/test2.geotiff"; }
code_block_5 = CodeBlock { "C:/TEMP/cea.tif"; }
python_script_2 = Python(IN[0]=code_block_5)
# ---------- python_script_2.python (24 lines) ----------
import clr
clr.AddReference('gdal_csharp')
clr.AddReference('PresentationCore')
clr.AddReference('System.Drawing')
clr.AddReference('System.IO')

from System.Windows.Media.Imaging import TiffBitmapDecoder
from System.Windows.Media.Imaging import BitmapCreateOptions
from System.Windows.Media.Imaging import BitmapCacheOption
from System.Drawing import Image
from System.IO import *

Imagepath= IN[0]

ImageStreamSource = FileStream(Imagepath, FileMode.Open, FileAccess.Read, FileShare.Read)

Decoder = TiffBitmapDecoder(ImageStreamSource,BitmapCreateOptions.PreservePixelFormat, BitmapCacheOption.Default)

BMP = Decoder.Frames
BMP2 = BMP[0].Metadata
#Decoder.Frames


OUT = BMP
# ----------------------------------------
mergeImages = Custom[GIS2BIM.MergeImages]()  # Merges a list of images to 1 image; unwired: images
code_block_6 = CodeBlock { "boskoop"; "warmoeskade"; "2"; }
getLocationdataNetherlands = Custom[GIS2BIM.GetLocationdataNetherlands](City=code_block_6.out0, Streetname=code_block_6.out1, Housenumber=code_block_6.out2)  # Gives locationdata based on an adress in the Netherlands
code_block_7 = CodeBlock { 200; 200; }
createBoundingBox = Custom[GIS2BIM.CreateBoundingBox](CoordinateX=getLocationdataNetherlands.RDcoordinateX_meters_double, CoordinateY=getLocationdataNetherlands.RDcoordinateY_meters_double, BoxWidth=code_block_7.out0, BoxHeight=code_block_7.out0)  # create boundingboxstring for webrequests based on coördinates and dimensions
geoservicesLibraryNetherlands = Custom[GIS2BIM.GeoservicesLibraryNetherlands](BoundingBox=createBoundingBox.Boxstring)  # Library with multiple webadresses which can be used for WFS and WMS webrequests
code_block_8 = CodeBlock { "C:/TEMP/test3.tif"; }
code_block_9 = CodeBlock { "https://geodata.nationaalgeoregister.nl/ahn3/wcs?SERVICE=WCS&VERSION=1.0.0&REQUEST=GetCoverage&FORMAT=image/tiff&COVERAGE=ahn3_5m_dsm&BBOX=99198.4917734710033983,485588.33618855383247137,106915.96004800940863788,494366.81641667388612404&CRS=EPSG:28992&RESPONSE_CRS=EPSG:28992&WIDTH=450&HEIGHT=512"; }
webrequestWMS2 = Custom[GIS2BIM.WebrequestWMS2](WMSwebrequest=code_block_9)  # a webrequest based on WMS-protocol
code_block_10 = CodeBlock { "C:/TEMP/test5.tiff"; }
systemDrawingBitmapToJPG = Custom[GIS2BIM.SystemDrawingBitmapToJPG](SystemDrawingBitmap=webrequestWMS2, FileName=code_block_10)  # Save an System.Drawing.Bitmap object as a jpg-file
