# Dynamo graph MaterialAssetProperties.dyn (Dynamo 1.3.3.4111)

code_block = CodeBlock { "f1_kalkzandsteen"; }
byName = Material.ByName(code_block)
appearanceParameters = Material.AppearanceParameters(byName)
materialAssetElement = Custom[Material.MaterialAssetElement](Material=byName)  # This node retrieves a Material Asset Element from Material. If such is not defined it will return an Invalid Element Id (-1)
code_block_2 = CodeBlock { "TextureRealWorldOffsetX"; }
code_block_3 = CodeBlock { 500; }
setParameterByName = Element.SetParameterByName(element=materialAssetElement, parameterName=code_block_2, value=code_block_3)
getParameterValueByName = Element.GetParameterValueByName(element=materialAssetElement, parameterName=code_block_2)
setMaterialAssetByAssetId = Custom[Material.SetMaterialAssetByAssetId]()  # This node will set the material asset by asset id. Please make sure that the two input lists match in length.; unwired: TargetMaterial, AssetId
setMaterialAssetByMaterial = Custom[Material.SetMaterialAssetByMaterial]()  # This node will copy a material asset element from source Material to a list of target materials. It esentially makes all materials inherit its Rendering Appearance. Useful for "clay" renderings.; unwired: TargetMaterial, SourceMaterial
python_script = Python(IN[0]=byName)
# ---------- python_script.python (49 lines) ----------
import clr
clr.AddReference("RevitNodes")
import Revit
clr.ImportExtensions(Revit.Elements)
clr.AddReference("RevitAPI")
import Autodesk
from Autodesk.Revit.DB import *
from Autodesk.Revit.DB.Visual import *

clr.AddReference("RevitServices")
import RevitServices
from RevitServices.Persistence import DocumentManager
from RevitServices.Transactions import TransactionManager

doc = DocumentManager.Instance.CurrentDBDocument

import sys

pyt_path = 'C:\Program Files (x86)\IronPython 2.7\Lib'
sys.path.append(pyt_path)

mat= IN[0]

mat2= UnwrapElement(mat)
doc = DocumentManager.Instance.CurrentDBDocument
AppearanceAsset = doc.GetElement(mat2.AppearanceAssetId)
AppearanceAssetid =AppearanceAsset.Id

RenderingAsset = AppearanceAsset.GetRenderingAsset()
#RenderingID = RenderingAsset.GetTypeId 

X = RenderingAsset.Name
Y = RenderingAsset.Title
Z = RenderingAsset.GetType()
ZA = RenderingAsset["common_Tint_color"]
ZB = ZA.GetValueAsColor()
ZC = RenderingAsset[UnifiedBitmap.UnifiedbitmapBitmap]
ZD = ZC.Name
ZE = RenderingAsset[Generic.GenericDiffuse]
ZF = ZE.Name
ZG = RenderingAsset[UnifiedBitmap.TextureScaleLock]
ZH = RenderingAsset[UnifiedBitmap.TextureRealWorldOffsetX]
ZI = ZH.Value
ZJ = RenderingAsset[UnifiedBitmap.UnifiedbitmapBitmap]
ZK = ZJ.Value
#TransactionManager.Instance.EnsureInTransaction(doc)
#TransactionManager.Instance.TransactionTaskDone()

OUT = mat2,AppearanceAsset, RenderingAsset, AppearanceAssetid
# ----------------------------------------
python_script_2 = Python(IN[0]=byName)
# ---------- python_script_2.python (60 lines) ----------
# Copyright(c) 2015, Konrad K Sobon
# @arch_laboratory, http://archi-lab.net

# Import Element wrapper extension methods
import clr
clr.AddReference("RevitNodes")
import Revit
clr.ImportExtensions(Revit.Elements)

# Import RevitAPI
clr.AddReference("RevitAPI")
import Autodesk
from Autodesk.Revit.DB import *

# Import DocumentManager and TransactionManager
clr.AddReference("RevitServices")
import RevitServices
from RevitServices.Persistence import DocumentManager
doc = DocumentManager.Instance.CurrentDBDocument

import sys
pyt_path = r'C:\Program Files (x86)\IronPython 2.7\Lib'
sys.path.append(pyt_path)

#The inputs to this node will be stored as a list in the IN variables.
dataEnteringNode = IN

def ProcessList(_func, _list):
	return map(lambda x: ProcessList(_func, x) if type(x)==list else _func(x), _list)

def TryGetAssetId(mat):
	doc = DocumentManager.Instance.CurrentDBDocument
	appearanceId = mat.AppearanceAssetId
	if appearanceId != ElementId.InvalidElementId:
		appearanceElemn = doc.GetElement(appearanceId)
		return appearanceElemn
	else:
		return ElementId.InvalidElementId

def Unwrap(item):
	return UnwrapElement(item)

if isinstance(IN[0], list):
	elements = ProcessList(Unwrap, IN[0])
else:
	elements = [Unwrap(IN[0])]

try:
	errorReport = None
	output = ProcessList(TryGetAssetId, elements)
except:
	# if error accurs anywhere in the process catch it
	import traceback
	errorReport = traceback.format_exc()

#Assign your output to the OUT variable
if errorReport == None:
	OUT = output
else:
	OUT = errorReport
# ----------------------------------------
imagesettings_file_types = Custom[ImageSettings File Types]()
importImageInView = Custom[GIS2BIM.ImportImageInView]()  # Import rasterimage in view; unwired: ImageWidthMeters, View, ImagePath
python_script_3 = Python(IN[0]=byName)
# ---------- python_script_3.python (62 lines) ----------
import clr
clr.AddReference("RevitNodes")
import Revit
clr.ImportExtensions(Revit.Elements)
clr.AddReference("RevitAPI")
import Autodesk
from Autodesk.Revit.DB import *
from Autodesk.Revit.DB.Visual import *

clr.AddReference("RevitServices")
import RevitServices
from RevitServices.Persistence import DocumentManager
from RevitServices.Transactions import TransactionManager

doc = DocumentManager.Instance.CurrentDBDocument

import sys

pyt_path = 'C:\Program Files (x86)\IronPython 2.7\Lib'
sys.path.append(pyt_path)

mat1= IN[0]

mat= UnwrapElement(mat1)
doc = DocumentManager.Instance.CurrentDBDocument
AppearanceAsset = doc.GetElement(mat.AppearanceAssetId)
RenderingAsset = AppearanceAsset.GetRenderingAsset()
AppearanceAssetid =AppearanceAsset.Id

A = RenderingAsset.Name
B = RenderingAsset.Title
C = RenderingAsset[UnifiedBitmap.UnifiedbitmapBitmap]
D = RenderingAsset[Generic.GenericDiffuse]
E = D.Name

F = RenderingAsset[UnifiedBitmap.TextureLinkTextureTransforms].Value
G = RenderingAsset[UnifiedBitmap.TextureOffsetLock].Value
H = RenderingAsset[UnifiedBitmap.TextureRealWorldOffsetX].GetConnectedProperty
I = RenderingAsset[UnifiedBitmap.TextureRealWorldOffsetY].Value
J = RenderingAsset[UnifiedBitmap.TextureRealWorldScaleX].Value
K = RenderingAsset[UnifiedBitmap.TextureRealWorldScaleY].Value
L = RenderingAsset[UnifiedBitmap.TextureScaleLock].Value
M = RenderingAsset[UnifiedBitmap.TextureURepeat].Value 
N = RenderingAsset[UnifiedBitmap.TextureVRepeat].Value 
O = RenderingAsset[UnifiedBitmap.TextureWAngle].Value 
P = RenderingAsset[UnifiedBitmap.UnifiedbitmapBitmap].Value 
Q = RenderingAsset[UnifiedBitmap.UnifiedbitmapInvert].Value 
R = RenderingAsset[UnifiedBitmap.UnifiedbitmapRGBAmount].Value 

#transactionManager.Instance.EnsureInTransaction(doc)

#editScope = AppearanceAssetEditScope(doc)
#AssetEditable = editScope.Start(AppearanceAssetid)

#Xvalue = AssetEditable[UnifiedBitmap.TextureRealWorldScaleX]
#XvalueNew = Xvalue.Value(5)

#editScope.Commit(true)

#TransactionManager.Instance.TransactionTaskDone()

OUT = mat,AppearanceAsset, RenderingAsset, A,B,C,D,E,F,G,H,I,J,K,L,M,N,O,P,Q,R
# ----------------------------------------
importImageInView_2 = Custom[GIS2BIM.ImportImageInView]()  # unwired: ImageWidthMeters, View, ImagePath
code_block_4 = CodeBlock {  }
