# Dynamo graph sandboxPointcloudCreateGeometry.dyn (Dynamo 1.3.1.1736)

# group: INPUT
code_block = CodeBlock { "Rotterdam"; "Wilhelminakade"; "200"; }
code_block_2 = CodeBlock { 700; }
views = Views("Situation")
string = StringInput("pen rood")
code_block_3 = CodeBlock { "C:/TEMP/"; }

# group: GET GEOSERVICES
getLocationdataNetherlands = Custom[GIStoBIM.GetLocationdataNetherlands](city=code_block.out0, streetname=code_block.out1, housenumber=code_block.out2)  # Gives locationdata based on an adress in the Netherlands
createBoundingBox = Custom[GIStoBIM.CreateBoundingBox](coordinateX=getLocationdataNetherlands.RDcoordinate_X_meters, coordinateY=getLocationdataNetherlands.RDcoordinate_Y_meters, boxWidth=code_block_2, boxHeight=code_block_2)  # create boundingboxstring for webrequests based on coördinates and dimensions
geoservicesLibraryNetherlands = Custom[GIStoBIM.GeoservicesLibraryNetherlands](BoundingBox=createBoundingBox)  # Library with multiple webadresses which can be used for WFS and WMS webrequests

code_block_4 = CodeBlock()
# ---------- code_block_4.designscript (1 lines) ----------
http://services.rce.geovoorziening.nl/rce/wfs?&request=GetCapabilities&service=WFS
# ----------------------------------------

# group: BAG: pand
web_request = WebRequest()  # unwired: arg0
code_block_5 = CodeBlock { "gml:posList"; }
boolean = BoolSelector(true)
createPointsPolygonFromGMLxyz = Custom[GIStoBIM.CreatePointsPolygonFromGMLxyz](xml=web_request, xmltagname=code_block_5, deltaX=getLocationdataNetherlands.RDcoordinate_X_meters, deltaY=getLocationdataNetherlands.RDcoordinate_Y_meters, connectpolygon=boolean)  # Create points and polygons from a xml/gml-file with x,y and z value
createDetailLinesFromPolygons = Custom[GIStoBIM.CreateDetailLinesFromPolygons](view=views, polyCurves=createPointsPolygonFromGMLxyz.PolyCurves, linestyle=string)  # Create detaillines from polygons in a view

file_path = Filename("D:\GEO\AHN2\AHNtest4.pts")
readText = File.ReadText(file_path)
python_script = Python(IN[0]=readText)
# ---------- python_script.python (30 lines) ----------
import clr
# Import RevitNodes
clr.AddReference("RevitNodes")
import Revit
# Import types we need. Instead of listing individual types,
# you can do 'from Revit.Elements import *'

import sys
sys.path.append("C:\Program Files (x86)\IronPython 2.7\Lib")

import itertools

clr.AddReference('ProtoGeometry')
from Autodesk.DesignScript.Geometry import *

input = IN[0]

pointlist = input.split()

def grouper(n, it):
    "grouper(3, 'ABCDEFG') --> ABC DEF G"
    it = iter(it)
    return iter(lambda: list(itertools.islice(it, n)), [])

pointlist = list(grouper(4, pointlist))

#for item in input.split("\n")
 #   output.append(item)
#Assign your output to the OUT variable.
OUT = pointlist
# ----------------------------------------
code_block_6 = CodeBlock(t2=python_script)
# ---------- code_block_6.designscript (5 lines) ----------
t1 = DSCore.List.Transpose(t2);
t5 = 1000*String.ToNumber(DSCore.List.GetItemAtIndex(t1, 0));
t6 = 1000*String.ToNumber(DSCore.List.GetItemAtIndex(t1, 1));
t7 = 1000*String.ToNumber(DSCore.List.GetItemAtIndex(t1, 2));
points = Point.ByCoordinates(t5,t6,t7);
# ----------------------------------------
code_block_7 = CodeBlock { 1; }
byPoints = NurbsSurface.ByPoints(code_block_6.points, code_block_7, code_block_7)
byPoints_2 = Topography.ByPoints()  # unwired: arg0
byMesh = DirectShape.ByMesh()  # unwired: arg0, arg1
volume = Autodesk.Dynamo.MeshToolkit.Mesh.Volume()  # unwired: arg0
reduce = Autodesk.Dynamo.MeshToolkit.Mesh.Reduce()  # unwired: arg0, arg1
