# Dynamo graph sandboxTMS.dyn (Dynamo 1.3.2.2480)

code_block = CodeBlock {  }
code_block_2 = CodeBlock { "zuidendijk"; "315"; "dordrecht"; "the netherlands"; }
geoCodingGoogleAPI = Custom[GIS2BIM.GeoCodingGoogleAPI](Streetname=code_block_2.out0, Housenumber=code_block_2.out1, Place=code_block_2.out2, Country=code_block_2.out3)  # gets coordinate from adress with google API
code_block_3 = CodeBlock { "https://mt1.google.com/vt/lyrs=m"; "&x="; "&y="; "&z="; }
getLocationdataNetherlands = Custom[GIS2BIM.GetLocationdataNetherlands](City=code_block_2.out2, Streetname=code_block_2.out0, Housenumber=code_block_2.out1)  # Gives locationdata based on an adress in the Netherlands
toNumber = String.ToNumber(getLocationdataNetherlands.Latitude)
toNumber_2 = String.ToNumber(getLocationdataNetherlands.Longitude)
code_block_4 = CodeBlock { 19; }
python_script = Python(IN[0]=toNumber, IN[1]=toNumber_2, IN[2]=code_block_4)
# ---------- python_script.python (14 lines) ----------
import sys
sys.path.append("C:\Program Files (x86)\IronPython 2.7\Lib")
import math

lat_deg = IN[0]
lon_deg = IN[1]
zoom = IN[2]

lat_rad = math.radians(lat_deg)
n = 2.0 ** zoom
xtile = int((lon_deg + 180.0) / 360.0 * n)
ytile = int((1.0 - math.log(math.tan(lat_rad) + (1 / math.cos(lat_rad))) / math.pi) / 2.0 * n)

OUT = xtile, ytile
# ----------------------------------------
firstItem = List.FirstItem(python_script)
string_from_object = FromObject(firstItem)
lastItem = List.LastItem(python_script)
string_from_object_2 = FromObject(lastItem)
string_from_object_3 = FromObject(code_block_4)
concat = String.Concat(code_block_3.out0, code_block_3.out1, string_from_object, code_block_3.out2, string_from_object_2, code_block_3.out3, string_from_object_3)
sendTo = Custom[Clipboard.SendTo]()  # Copies a string to the clipboard.; unwired: str
code_block_5 = CodeBlock { "https://mt1.google.com/vt/lyrs=s"; "&x="; "&y="; "&z="; }
code_block_6 = CodeBlock { 300; }
createBoundingBoxLATLONG = Custom[GIS2BIM.CreateBoundingBoxLATLONG](Lat=getLocationdataNetherlands.Latitude, Long=getLocationdataNetherlands.Longitude, WidthMeters=code_block_6)  # create boundingbox with from lat/long coordinate in degrees
code_block_7 = CodeBlock(Xleft=createBoundingBoxLATLONG.East, Xright=createBoundingBoxLATLONG.West, Ybottom=createBoundingBoxLATLONG.North, Ytop=createBoundingBoxLATLONG.South)
# ---------- code_block_7.designscript (16 lines) ----------
//BOUNDINGBOX
Xleft;
Xright;
Ybottom;
Ytop;

X= {Xleft,Xright};
Y= {Ybottom,Ytop};




//tilerows
//tilecolumns
//XLEFT YBOTTOM
//XRIGHT YTOP
# ----------------------------------------
python_script_2 = Python(IN[0]=code_block_7.Ybottom, IN[1]=code_block_7.Xleft, IN[2]=code_block_4)  # same code as python_script
firstItem_2 = List.FirstItem(python_script_2)
string_from_object_4 = FromObject(firstItem_2)
lastItem_2 = List.LastItem(python_script_2)
string_from_object_5 = FromObject(lastItem_2)
string_from_object_6 = FromObject(code_block_4)
concat_2 = String.Concat(code_block_5.out0, code_block_5.out1, string_from_object_4, code_block_5.out2, string_from_object_5, code_block_5.out3, string_from_object_6)
sendTo_2 = Custom[Clipboard.SendTo](str=concat_2)
WMTSRequestAndImport = Custom[GIS2BIM.WMTSRequestAndImport]()  # total node with WMTS webrequest and import of image in view; unwired: Rdx, Rdy, Zoomlevel, Boundingboxwidth, TemppathFiles, View, Layer
toNumber_3 = String.ToNumber(getLocationdataNetherlands.Latitude)
toNumber_4 = String.ToNumber(getLocationdataNetherlands.Longitude)
map = List.Map()  # unwired: list, f_x
python_script_3 = Python(IN[0]=concat_2)
# ---------- python_script_3.python (19 lines) ----------
import sys
sys.path.append("C:\Program Files (x86)\IronPython 2.7\Lib")

import clr

clr.AddReference("System.Drawing")
clr.AddReference("System")
from System.Drawing import Image
from System.Drawing import Bitmap
from System.Drawing import Graphics
from System.Drawing.Imaging import ImageFormat
from System.Net import WebRequest
url= IN[0]

request = WebRequest.Create(url)
response = request.GetResponse()
bitmap = Image.FromStream(response.GetResponseStream())

OUT = bitmap
# ----------------------------------------
webrequestWMS = Custom[GIS2BIM.WebrequestWMS]()  # imports the result(image) of a webrequest based on WMS-protocol into a view in Revit; unwired: WMSwebrequest, Boundingboxwidth, View, Filename
code_block_8 = CodeBlock { "C:/TEMP/test.jpg"; }
python_script_4 = Python(IN[0]=concat_2, IN[1]=code_block_8)
# ---------- python_script_4.python (11 lines) ----------
import sys
sys.path.append("C:\Program Files (x86)\IronPython 2.7\Lib")
from urllib import urlretrieve

url= IN[0]
tempfile= IN[1]


urlretrieve(url, tempfile)

OUT= tempfile
# ----------------------------------------
