# Dynamo graph GIS2x_1.2 Set Shared Coordinate.dyn (Dynamo 2.2.1.5175)

code_block = CodeBlock { "28992"; }
GIS2BIM_GetRevitSiteLocation = Custom[GIS2BIM_GetRevitSiteLocation]()  # Gets the properties of the current Site Location of the active Revit Project
toNumber = String.ToNumber(str=GIS2BIM_GetRevitSiteLocation.Lon)
toNumber_2 = String.ToNumber(str=GIS2BIM_GetRevitSiteLocation.Lat)
GIS2BIM_TransformCRS_epsg = Custom[GIS2BIM_TransformCRS_epsg](TargetCRS=code_block, xCoordinate=toNumber, yCoordinate=toNumber_2)  # Uses the API of http://epsg.io to transform Coordinate Reference Systems
GIS2BIM_SetSharedCoordinate = Custom[GIS2BIM_SetSharedCoordinate](x=GIS2BIM_TransformCRS_epsg.Xtransformed, y=GIS2BIM_TransformCRS_epsg.Ytransformed)  # Set shared coordinate/project basepoint
