# Dynamo graph GIS2x_4.2 AHN3 Toposurface.dyn (Dynamo 2.10.1.3976)
# packages: GIS2BIM for Dynamo 2.x 0.11.10

code_block = CodeBlock { "28992"; }
GIS2BIM_GetRevitSiteLocation = Custom[GIS2BIM_GetRevitSiteLocation]()  # package GIS2BIM for Dynamo 2.x; Gets the properties of the current Site Location of the active Revit Project
toNumber = String.ToNumber(str=GIS2BIM_GetRevitSiteLocation.Lon)
toNumber_2 = String.ToNumber(str=GIS2BIM_GetRevitSiteLocation.Lat)
GIS2BIM_TransformCRS_epsg = Custom[GIS2BIM_TransformCRS_epsg](TargetCRS=code_block, xCoordinate=toNumber, yCoordinate=toNumber_2)  # package GIS2BIM for Dynamo 2.x; Uses the API of http://epsg.io to transform Coordinate Reference Systems
afmeting_boundingbox_in_meters = IntegerSlider(400, range=100..1000 step 1)  # "Afmeting boundingbox in meters(breedte, hoogte)"; graph input
resolutie_geotiff = IntegerSlider(200, range=100..300 step 1)  # graph input
string_from_object = FromObject(obj=resolutie_geotiff)
opvulhoogte_leeg_vlak_in_meters = IntegerSlider(-1, range=-30..300 step 1)  # "Opvulhoogte leeg vlak in meters NAP"; graph input

# group: Bepaal bestandsnaam
current = Document.Current()
filePath = Document.FilePath(document=current)
code_block_2 = CodeBlock { ".rvt"; "AHN3points.tiff"; }
replace = String.Replace(string=filePath, searchFor=code_block_2.out0, replaceWith=code_block_2.out1)

code_block_3 = CodeBlock()
# ---------- code_block_3.designscript (10 lines) ----------
//CHOOSE AHN-LAYER

//maaiveld resolutie 0.5 m
"ahn3_05m_dtm";
//maaiveld+bomen+gebouwen enz. resolutie 0.5 m
"ahn3_05m_dsm";
//maaiveld resolutie 5 m
"ahn3_5m_dtm";
//maaiveld+bomen+gebouwen enz. resolutie 5 m
"ahn3_5m_dsm";
# ----------------------------------------
GIS2BIM_AHN3toPoints = Custom[GIS2BIM_AHN3toPoints](RdX=GIS2BIM_TransformCRS_epsg.Xtransformed, RdY=GIS2BIM_TransformCRS_epsg.Ytransformed, BoundinxboxWidth=afmeting_boundingbox_in_meters, ResolutionGeotiff=string_from_object, WaterlevelHeight=opvulhoogte_leeg_vlak_in_meters, FilepathName=replace, Layer=code_block_3.out0)  # package GIS2BIM for Dynamo 2.x; Load AHN3 via Geotiff WCS. Transform to local coordinates
isNull = Object.IsNull(object=GIS2BIM_AHN3toPoints.PointsSurface)
filterByBoolMask = List.FilterByBoolMask(list=GIS2BIM_AHN3toPoints.PointsSurface, mask=isNull)
flatten = List.Flatten(list=filterByBoolMask.out)
reductie_aantal_punten_in = IntegerSlider(10, range=1..20 step 1)  # "Reductie aantal punten in watervlak"; graph input

# group: Reduceer aantal punten zonder hoogtedata ten behoeve van snelheid
isNull_2 = Object.IsNull(object=GIS2BIM_AHN3toPoints.PointsNoElevationData)
filterByBoolMask_2 = List.FilterByBoolMask(list=GIS2BIM_AHN3toPoints.PointsNoElevationData, mask=isNull_2)
flatten_2 = List.Flatten(list=filterByBoolMask_2.out)
code_block_4 = CodeBlock { 5; }
takeEveryNthItem = List.TakeEveryNthItem(list=flatten_2, n=reductie_aantal_punten_in, offset=code_block_4)

# group: Maak BAG-solids ten behoeve van filtering points onder gebouwen
GIS2BIM_CreateBoundingBox = Custom[GIS2BIM_CreateBoundingBox](CoordinateX=GIS2BIM_TransformCRS_epsg.Xtransformed, CoordinateY=GIS2BIM_TransformCRS_epsg.Ytransformed, BoxWidth=afmeting_boundingbox_in_meters, BoxHeight=afmeting_boundingbox_in_meters)  # package GIS2BIM for Dynamo 2.x; create boundingboxstring for webrequests based on coördinates and dimensions
GIS2BIM_NetherlandsGeoservicesLibrary = Custom[GIS2BIM_NetherlandsGeoservicesLibrary](BoundingBoxEPSG28992=GIS2BIM_CreateBoundingBox.Boxstring)  # package GIS2BIM for Dynamo 2.x; Library with multiple webadresses which can be used for WFS and WMS webrequests
web_request = WebRequest(url=GIS2BIM_NetherlandsGeoservicesLibrary.4_bag_pand_OGC_WFS)
GIS2BIM_CreatePointsPolygonFromGMLxyz = Custom[GIS2BIM_CreatePointsPolygonFromGMLxyz](XML=web_request, DeltaX=GIS2BIM_TransformCRS_epsg.Xtransformed, DeltaY=GIS2BIM_TransformCRS_epsg.Ytransformed)  # package GIS2BIM for Dynamo 2.x; Create points and polygons from a xml/gml-file with x,y and z value
byPatch = Surface.ByPatch(closedCurve=GIS2BIM_CreatePointsPolygonFromGMLxyz.PolyCurves)
code_block_5 = CodeBlock { 50000; }
thicken = Surface.Thicken(surface=byPatch, thickness=code_block_5)
byUnion = Solid.ByUnion(solids=thicken)

doesIntersect = Geometry.DoesIntersect(geometry=byUnion, other=takeEveryNthItem)
filterByBoolMask_3 = List.FilterByBoolMask(list=takeEveryNthItem, mask=doesIntersect)
join = List.Join(list0=flatten, list1=filterByBoolMask_3.out)
byPoints = Topography.ByPoints(points=join)
code_block_6 = CodeBlock()
# ---------- code_block_6.designscript (2 lines) ----------
//number of pixels Geotiff
"200";
# ----------------------------------------
