# Dynamo graph GIS2BIM_BAG 3D.dyn (Dynamo 2.2.1.5175)

GIS2BIM_GetSharedCoordinate = Custom[GIS2BIM_GetSharedCoordinate]()  # Get the current shared coordinate
code_block = CodeBlock(RDX=GIS2BIM_GetSharedCoordinate.EastWest, RDY=GIS2BIM_GetSharedCoordinate.NorthSouth) { RDX; RDY; }
width_boundingbox = CodeBlock { 1000; }
GIS2BIM_CreateBoundingBox = Custom[GIS2BIM_CreateBoundingBox](CoordinateX=code_block.RDX, CoordinateY=code_block.RDY, BoxWidth=width_boundingbox, BoxHeight=width_boundingbox)  # create boundingboxstring for webrequests based on coördinates and dimensions

# group: BOUNDINGBOX EN CONSTRUEER WEBREQUEST
GIS2BIM_NetherlandsGeoservicesLibrary = Custom[GIS2BIM_NetherlandsGeoservicesLibrary](BoundingBoxEPSG28992=GIS2BIM_CreateBoundingBox.Boxstring)  # Library with multiple webadresses which can be used for WFS and WMS webrequests

GIS2BIM_BAG3D = Custom[GIS2BIM_BAG3D](BAG3DTUDelft_OGCWFS=GIS2BIM_NetherlandsGeoservicesLibrary.3D_BAG_TU_Delft_OGC_WFS, RdX=code_block.RDX, RdY=code_block.RDY)  # Perform a WFS(Web Feature Service) webrequest based on a boundingbox of RD-coordinates(28992). Retrieve an xml-file. Read the metadata and create 3D-solids. Maximum of 1000 buildings per request.
byUnion = Solid.ByUnion(solids=GIS2BIM_BAG3D.BAG_3DSolids_Per_Building)
file_path = Filename("..\..\..\..\..\..\..\..\ProgramData\Autodesk\RVT 2019\Family Templates\English\Conceptual Mass\Metric Mass.rft")  # graph input

# group: PLACE FAMILY
code_block_2 = CodeBlock { "NLRS_90_MA_BAG_3D.rfa"; ".rfa"; }
categories = Categories("OST_Mass")  # graph input
code_block_3 = CodeBlock { "Form"; }
byGeometry = Custom[Springs.FamilyInstance.ByGeometry](geometry=byUnion, familyTemplatePath=file_path, familyName=code_block_2.out0, category=categories, subcategoryName=code_block_3)  # frozen; You must provide a valid family template path that will be used for all input geometry objects. The project units(and not the templates) will be used to determine the size of the output geometry. The provided category will be used only if the family template supports it. If not, the default template category will be used instead. Likewise, the family material(provided as a string) will be set only if a material with that name exists in the template. If not, the default material will be used instead ("By Category"). For void cuts, the material settings will be ignored. The Subcategory name is an optional input. If you'd like to skip assigning a Subcategory to any new instance, simply use null. The node expects a unique family name for each geometry object. The rest of the input lists will be processed as if the node lacing is set to longest.

# group: OR USE REVIT SITE LOCATION
code_block_4 = CodeBlock { "4326"; "28992"; }
GIS2BIM_GetRevitSiteLocation = Custom[GIS2BIM_GetRevitSiteLocation]()  # Gets the properties of the current Site Location of the active Revit Project
GIS2BIM_TransformCRS_epsg = Custom[GIS2BIM_TransformCRS_epsg](SourceCRS=code_block_4.out0, TargetCRS=code_block_4.out1, xCoordinate=GIS2BIM_GetRevitSiteLocation.Lon, yCoordinate=GIS2BIM_GetRevitSiteLocation.Lat)  # Uses the API of http://epsg.io to transform Coordinate Reference Systems

# group: GEOCODING
code_block_5 = CodeBlock { "dordrecht"; "zuidendijk"; "315"; }
GIS2BIM_GetLocationdataNetherlands = Custom[GIS2BIM_GetLocationdataNetherlands](City=code_block_5.out0, Streetname=code_block_5.out1, Housenumber=code_block_5.out2)  # Gives locationdata based on an adress in the Netherlands
