# Dynamo graph GIS2BIM_GeoTIFF.dyn (Dynamo 2.2.1.5175)

# group: GEOCODING
code_block = CodeBlock { "Kamperland"; "Sophiaboulevard"; "23"; }
GIS2BIM_GetLocationdataNetherlands = Custom[GIS2BIM_GetLocationdataNetherlands](City=code_block.out0, Streetname=code_block.out1, Housenumber=code_block.out2)  # Gives locationdata based on an adress in the Netherlands

code_block_2 = CodeBlock()
# ---------- code_block_2.designscript (2 lines) ----------
//width boundingbox
1000;
# ----------------------------------------
code_block_3 = CodeBlock()
# ---------- code_block_3.designscript (2 lines) ----------
//number of pixels Geotiff
"200";
# ----------------------------------------
code_block_4 = CodeBlock()
# ---------- code_block_4.designscript (2 lines) ----------
//temp filepath Geotiff
"C:/TEMP/test20.tiff";
# ----------------------------------------
code_block_5 = CodeBlock()
# ---------- code_block_5.designscript (10 lines) ----------
//CHOOSE AHN-LAYER

//maaiveld resolutie 0.5 m
"ahn3_05m_dtm";
//maaiveld+bomen+gebouwen enz. resolutie 0.5 m
"ahn3_05m_dsm";
//maaiveld resolutie 5 m
"ahn3_5m_dtm";
//maaiveld+bomen+gebouwen enz. resolutie 5 m
"ahn3_5m_dsm";
# ----------------------------------------
GIS2BIM_AHN3toPoints = Custom[GIS2BIM_AHN3toPoints](RdX=GIS2BIM_GetLocationdataNetherlands.RDcoordinateXmeters, RdY=GIS2BIM_GetLocationdataNetherlands.RDcoordinateYmeters, BoundinxboxWidth=code_block_2, ResolutionGeotiff=code_block_3, FilepathName=code_block_4, Layer=code_block_5.out0)  # Load AHN3 via Geotiff WCS. Transform to local coordinates
flatten = List.Flatten(list=GIS2BIM_AHN3toPoints.Points)
byPoints = Topography.ByPoints(points=flatten)
mesh = Topography.Mesh(topography=byPoints)  # frozen
GIS2BIM_SetSharedCoordinate = Custom[GIS2BIM_SetSharedCoordinate](x=GIS2BIM_GetLocationdataNetherlands.RDcoordinateXmeters, y=GIS2BIM_GetLocationdataNetherlands.RDcoordinateYmeters)  # Set shared coordinate/project basepoint
