# Dynamo graph sandbox.dyn (Dynamo 1.3.1.1736)

code_block = CodeBlock()
# ---------- code_block.designscript (1 lines) ----------
http://services.rce.geovoorziening.nl/rce/wfs?&request=GetCapabilities&service=WFS
# ----------------------------------------
kadaster = Custom[GIStoBIM.Kadaster]()  # Draw propertylines and place streetnames and housenumbers from the dutch kadaster; unwired: url_webrequest, deltaX, deltaY, view
views = Views("Situation")
code_block_2 = CodeBlock(view=views) { view: Revit.View; }
from_meters_to_millimeters = CodeBlock { 1000; }
code_block_3 = CodeBlock { "Dordrecht"; "Lange geldersekade"; "1"; }
getLocationdataNetherlands = Custom[GIStoBIM.GetLocationdataNetherlands](city=code_block_3.out0, streetname=code_block_3.out1, housenumber=code_block_3.out2)  # Gives locationdata based on an adress in the Netherlands
code_block_4 = CodeBlock { 300; }
createBoundingBox = Custom[GIStoBIM.CreateBoundingBox](coordinateX=getLocationdataNetherlands.RDcoordinate_X_meters, coordinateY=getLocationdataNetherlands.RDcoordinate_Y_meters, boxWidth=code_block_4, boxHeight=code_block_4)  # create boundingboxstring for webrequests based on coördinates and dimensions
geoservicesLibraryNetherlands = Custom[GIStoBIM.GeoservicesLibraryNetherlands](BoundingBox=createBoundingBox)  # Library with multiple webadresses which can be used for WFS and WMS webrequests
web_request = WebRequest(geoservicesLibraryNetherlands.7_kadastrale_annotatie)
code_block_5 = CodeBlock { "gml:pos"; }
getXMLNode = Lists.DataSets.GetXMLNode(web_request, code_block_5)
flatten = Flatten(getXMLNode)
code_block_6 = CodeBlock { " "; }
split = String.Split(flatten, code_block_6)
toNumber = String.ToNumber(split)
code_block_7 = CodeBlock { 1; 2; 0; }
rd_x = List.TakeEveryNthItem(arg1=code_block_7.out1, arg2=code_block_7.out0)  # unwired: arg0
map = List.Map(list=toNumber, f_x=rd_x)
mul = from_meters_to_millimeters * map
code_block_8 = CodeBlock(deltaX=getLocationdataNetherlands.RDcoordinate_X_meters)
# ---------- code_block_8.designscript (2 lines) ----------
//X-value of transformation of points and polygons
deltaX;
# ----------------------------------------
mul_2 = code_block_8 * from_meters_to_millimeters
x_convert_to_local_axis = mul - mul_2
rd_y = List.TakeEveryNthItem(arg1=code_block_7.out1, arg2=code_block_7.out2)  # unwired: arg0
map_2 = List.Map(list=toNumber, f_x=rd_y)
mul_3 = from_meters_to_millimeters * map_2
code_block_9 = CodeBlock(deltaY=getLocationdataNetherlands.RDcoordinate_Y_meters)
# ---------- code_block_9.designscript (2 lines) ----------
//Y-value of transformation of points and polygons
deltaY;
# ----------------------------------------
mul_4 = code_block_9 * from_meters_to_millimeters
y_convert_to_local_axis = mul_3 - mul_4
code_block_10 = CodeBlock { 0; }
byCoordinates = Point.ByCoordinates(x=x_convert_to_local_axis, y=y_convert_to_local_axis, z=code_block_10)
pruneDuplicates = Point.PruneDuplicates(points=byCoordinates)
flatten_2 = Flatten(pruneDuplicates)
code_block_11 = CodeBlock { "kadastralekaartv3:classificatiecode"; }
getXMLNode_2 = Lists.DataSets.GetXMLNode(web_request, code_block_11)
flatten_3 = Flatten(getXMLNode_2)
code_block_12 = CodeBlock { "kadastralekaartv3:tekst"; }
getXMLNode_3 = Lists.DataSets.GetXMLNode(web_request, code_block_12)
flatten_4 = Flatten(getXMLNode_3)
code_block_13 = CodeBlock { "2.5 mm"; }
byName = TextNoteType.ByName(code_block_13)

# group: HUISNUMMER
string = StringInput("Z02")
eq = string == flatten_3
filterByBoolMask = List.FilterByBoolMask(list=flatten_4, mask=eq)
flatten_5 = Flatten(filterByBoolMask.in)
string_2 = StringInput("Center")

code_block_14 = CodeBlock { "kadastralekaartv3:rotatiehoek"; }
getXMLNode_4 = Lists.DataSets.GetXMLNode(web_request, code_block_14)
flatten_6 = Flatten(getXMLNode_4)
code_block_15 = CodeBlock { "3.5 mm"; }
byName_2 = TextNoteType.ByName(code_block_15)

# group: STRAATNAMEN
filterByBoolMask_2 = List.FilterByBoolMask(list=flatten_2, mask=eq)
filterByBoolMask_3 = List.FilterByBoolMask(list=flatten_6, mask=eq)
flatten_7 = Flatten(filterByBoolMask_2.out)
flatten_8 = Flatten(filterByBoolMask.out)
boolean = BoolSelector(true)
changeCase = String.ChangeCase(flatten_8, boolean)
string_3 = StringInput("Center")
flatten_9 = Flatten(filterByBoolMask_3.out)
toNumber_2 = String.ToNumber(flatten_9)
byLocation = TextNote.ByLocation(view=code_block_2, location=flatten_7, text=changeCase, alignment=string_3, type=byName_2, rotation=toNumber_2)

# group (continued): HUISNUMMER
flatten_10 = Flatten(filterByBoolMask_2.in)
flatten_11 = Flatten(filterByBoolMask_3.in)
toNumber_3 = String.ToNumber(flatten_11)
byLocation_2 = TextNote.ByLocation(view=code_block_2, location=flatten_10, text=flatten_5, alignment=string_2, type=byName, rotation=toNumber_3)

code_block_16 = CodeBlock { url webrequest; }
