# Dynamo graph sandboxWMTS.dyn (Dynamo 1.3.1.1736)

code_block = CodeBlock { "Dordrecht"; "lange geldersekade"; "2"; }
getLocationdataNetherlands = Custom[GIStoBIM.GetLocationdataNetherlands](city=code_block.out0, streetname=code_block.out1, housenumber=code_block.out2)  # Gives locationdata based on an adress in the Netherlands
code_block_2 = CodeBlock { 400; }
createBoundingBox = Custom[GIStoBIM.CreateBoundingBox](coordinateX=getLocationdataNetherlands.RDcoordinate_X_meters, coordinateY=getLocationdataNetherlands.RDcoordinate_Y_meters, boxWidth=code_block_2, boxHeight=code_block_2)  # create boundingboxstring for webrequests based on coördinates and dimensions
code_block_3 = CodeBlock { 14; }
WMTSScaleSetNetherlands = Custom[GIStoBIM.WMTSScaleSetNetherlands](Zoomlevel=code_block_3)  # gives resolution, scaledenominator and number of tiles
WMTSZoomLevelTileRow = Custom[GIStoBIM.WMTSZoomLevelTileRow](Zoomlevel=WMTSScaleSetNetherlands.Zoomlevel, Resolution=WMTSScaleSetNetherlands.Resolutie_m_pixel, NumberofTiles=WMTSScaleSetNetherlands.numberoftiles, Rdx=getLocationdataNetherlands.RDcoordinate_X_meters, Rdy=getLocationdataNetherlands.RDcoordinate_Y_meters)  # gives the tilerow and tilecolumn for the WMTS webrequest
WMTSLayersNetherlands = Custom[GIStoBIM.WMTSLayersNetherlands]()  # Library with layers for webrequests of WMTS-services in the Netherlands
WMTSGeoservicesLibraryNetherlands = Custom[GIStoBIM.WMTSGeoservicesLibraryNetherlands](TileRow=WMTSZoomLevelTileRow.TileRow, TileColumn=WMTSZoomLevelTileRow.TileColumn, Zoomlevel=WMTSScaleSetNetherlands.Zoomlevel, Layer=WMTSLayersNetherlands.ahn2_05m_ruw)  # library with webrequests of WMTS-services in the Netherlands
sendTo = Custom[Clipboard.SendTo](str=WMTSGeoservicesLibraryNetherlands)  # Copies a string to the clipboard.
