# Dynamo graph sandboxWMTS2.dyn (Dynamo 1.3.1.1736)

code_block = CodeBlock { "Dordrecht"; "lange geldersekade"; "2"; }
getLocationdataNetherlands = Custom[GIStoBIM.GetLocationdataNetherlands](city=code_block.out0, streetname=code_block.out1, housenumber=code_block.out2)  # Gives locationdata based on an adress in the Netherlands
zoomlevel = CodeBlock { 14; 300; "C:/TEMP/WMTS/"; }
views = Views("Situation")
WMTSLayersNetherlands = Custom[GIStoBIM.WMTSLayersNetherlands]()  # Library with layers for webrequests of WMTS-services in the Netherlands
WMTSRequestAndImport = Custom[GIStoBIM.WMTSRequestAndImport](rdx=getLocationdataNetherlands.RDcoordinate_X_meters, rdy=getLocationdataNetherlands.RDcoordinate_Y_meters, Zoomlevel=zoomlevel.out0, Boundingboxwidth=zoomlevel.out1, TemppathFiles=zoomlevel.out2, view=views, layer=WMTSLayersNetherlands.bag)  # total node with WMTS webrequest and import of image in view
watch_image = WatchImageCore(WMTSRequestAndImport)
